vi "ImageCropper.gvi"   [LabVIEW NXG 5.1.0]
panel controls:
  "Source Path": "Source Path.gtype"
  "Destination Path": path
  "CropIt": bool
  "Stop": bool
panel indicators:
  "Source Image": "Vision IMAQImage"
  "Destination Image": "Vision IMAQImage"
  "version": string
types:
  "Source Path.gtype" = path
uses:
  NI::G Core::File IO (General)::File Version Information.gvi
  NI::Vision::Core::Basics::Create Image.gvi
  NI::Vision::Core::Files::Read Image File.gvi
  NI::Vision::Algorithms::Image Manipulation::Extract Tetragon (ROI).gvi
  NI::Vision::Core::Files::Write Image And Vision Information File.gvi
diagram:
  Get Component Directory() -> (Path=w1)
  Strip Path(path=w1) -> (name=w2)
  Build Path(base path=w1, name or relative path=w2) -> (appended path=w3)
  call "File Version Information.gvi"(executable or DLL=w3) -> (file version=w4)
  $version <- w4
  while {
    case ($CropIt) {
      frame False, Default {
        Wait(time to wait=50)
      }
      frame True {
        call "Create Image.gvi"(image name="src", image type="Grayscale (U16)"(7)) -> (new image=w5)
        call "Read Image File.gvi"(image in=w5, file path=$"Source Path") -> (image out=w6)
        $"Source Image" <- w6
        Property Node(instance in=reference to "Source Image") -> ("ROI"=w7)
        call "Create Image.gvi"(image name="dst", image type="Grayscale (U16)"(7)) -> (new image=w8)
        call "Extract Tetragon (ROI).gvi"(image src=w6, image dst=w8, ROI descriptor=w7) -> (image dst out=w9)
        call "Write Image And Vision Information File.gvi"(image in=w9, file path=$"Destination Path")
        $"Destination Image" <- w9
      }
    }
    stop if $Stop
  }
