vi "Control Window.gvi"   [LabVIEW Conversion 5.1.0]
# This VI acts as a "Master" for various VIs that use the LVPostMessage function in the LVWUTIL.DLL library.  This is basically just the PostMessage API function with a WM_SYSCOMMAND message, but also does some additional checking for the existance of the targeted window.
inputs:
  "window refnum": u64  # The window refnum identifies the main window of the application to be closed. If it is not valid, the function will use the window name input to get a window refnum (if the window name is valid).
  "Function": T1 = "SW_SHOW"
  "error in": error
outputs:
  "dup window refnum": u64  # The window refnum identifies the main window of the application to be closed. If it is not valid, the function will use the window name input to get a window refnum (if the window name is valid).
  "error out": error
types:
  T1 = enum{"SW_HIDE", "SW_SHOWNORMAL", "SW_SHOWMINIMIZED", "SW_MAXIMIZE", "SW_SHOWNOACTIVATE", "SW_SHOW", "SW_MINIMIZE", "SW_SHOWMINNOACTIVATE", "SW_SHOWNA", "SW_RESTORE", "SW_SHOWDEFAULT", "SW_FORCEMINIMIZE"}
uses:
  Main::user32.sli::IsWindow
  Main::user32.sli::ShowWindow
diagram:
  case ($"error in") {
    frame No Error {
      call "IsWindow"(hWnd in=$"window refnum") -> (IsWindow?=w3, hWnd out=w4)
      case (w3) {
        frame 0 {
          Property Node(instance in=$"error in", "status"=TRUE, "code"=6002, "source"="Control Window.vi") -> (instance out=w1)
          w2 = default
        }
        frame Default {
          To Signed 32 Bit Integer(number=$Function) -> w5
          call "ShowWindow"(hWnd in=w4, function in=w5) -> (hWnd out=w2)
          w1 = $"error in"
        }
      }
    }
    frame Error {
      w1 = $"error in"
      w2 = $"window refnum"
    }
  }
  $"dup window refnum" <- w2
  $"error out" <- w1
