vi "Extract Window Origin - Size.gvi"   [LabVIEW Conversion 5.1.0]
# This VI will extract the size and origin of a window using the window rectangle as an input.  This information is useful when moving or resizing a window.
inputs:
  "window rect": T1  # This cluster contains the coordinates of the window in pixels: upper left and lower right corners.
outputs:
  "window origin": cluster{"left": i16, "top": i16}
  "window size": cluster{"Width": i16, "Height": i16}
types:
  T1 = cluster{"left": i16, "top": i16, "right": i16, "bottom": i16}
diagram:
  Property Node(instance in=$"window rect") -> ("right"=w1, "left"=w2, "bottom"=w3, "top"=w4)
  Property Node(instance in=$"window origin", "left"=w2, "top"=w4) -> (instance out=w5)
  $"window origin" <- w5
  Subtract(x=w1, y=w2) -> w6
  Subtract(x=w3, y=w4) -> w7
  Property Node(instance in=$"window size", "Width"=w6, "Height"=w7) -> (instance out=w8)
  $"window size" <- w8
