vi "Flash Title Bar.gvi"   [LabVIEW NXG 5.1.0]
# This function will  make the title bar of the window named in the 'window name' input, or identified by the 'window refnum' flash once, the state of the title bar changing at the specified rate the given number of times.  If 'not a window refnum' is passed in, then the function will use the window name to get a window window refnum.  If the window cannot be found, an error will be returned.
inputs:
  "window refnum": u64  # Identifies the window whose title bar should be flashed. If not valid, the window name input is used.
  "window name (\"\")": string
  "number of flashes (1)": i32 = 1
  "error in": error
  "flash time": u32 = 100
outputs:
  "window refnum out": u64  # Identifies the window whose title bar was flashed.
  "error out": error
uses:
  Main::Get Window RefNum.gvi
  Main::user32.sli::FlashWindow
diagram:
  case ($"window refnum") {
    frame Default {
      w1 = $"window refnum"
      w2 = $"error in"
    }
    frame 0 {
      call "Get Window RefNum.gvi"(window name ("")=$"window name (\"\")", error in=$"error in") -> (window refnum (NaWR)=w1, error out=w2)
    }
  }
  $"window refnum out" <- w1
  case (w2) {
    frame No Error { }
    frame Error {
      for (N = $"number of flashes (1)") {
        for (N = 2) {
          call "FlashWindow"(hWnd in=w1, fInvert in=1) -> (active?=w3)
          sequence (after w3) {
            frame 0 {
              Wait(time to wait=$"flash time")
            }
          }
        }
      }
    }
  }
  $"error out" <- w2
