vi "Generate String Buffer.gvi"   [LabVIEW Conversion 5.1.0]
inputs:
  "buffer size": i32  # Determines the length of the string buffer to be created.
outputs:
  "string buffer": string
diagram:
  w1 = 0  # U8
  Initialize Array(element=w1, size=$"buffer size") -> w2
  Byte Array To String(encoding="Extended ASCII", unsigned byte array=w2) -> (string=w3)
  $"string buffer" <- w3
