vi "Get VI FrontPanel RefNum.gvi"   [LabVIEW NXG 5.1.0]
inputs:
  "VI Ref": VIRefnum
  "error in": error
outputs:
  "VI Ref out": VIRefnum
  "window refnum": u64  # The window refnum identifies the main window of the application to be closed. If it is not valid, the function will use the window name input to get a window refnum (if the window name is valid).
  "error out": error
uses:
  Main::Get Window RefNum.gvi
diagram:
  Property Node(instance in=$"VI Ref", error in=$"error in") -> ("Panel"=w1, error out=w2, instance out=w3)
  $"VI Ref out" <- w3
  $"error out" <- w2
  Property Node(instance in=w1) -> ("Window"=w4)
  Property Node(instance in=w4) -> ("Title"=w5)
  call "Get Window RefNum.gvi"(window name ("")=w5) -> (window refnum (NaWR)=w6)
  $"window refnum" <- w6
