vi "Get Window Name.gvi"   [LabVIEW NXG 5.1.0]
# This VI will use window refnum in to get the name of a window.  The name of a window is simply the text appearing in the title bar of the window.  If the title bar of the window is not shown, the name of the window will be a NULL string.
inputs:
  "window refnum in (NaWR)": u64  # The window refnum in identifies the window whose name is to be retrieved.
  "error in": error
outputs:
  "window refnum out": u64  # window refnum out is the same as window refnum in if window refnum in is valid. If an error occured, window refnum out is invalid.
  "window name": string
  "error out": error
uses:
  Main::user32.sli::IsWindow
  Main::user32.sli::GetWindowTextLengthA
  Main::Generate String Buffer.gvi
  Main::user32.sli::GetWindowTextA
diagram:
  case ($"error in") {
    frame No Error {
      call "IsWindow"(hWnd in=$"window refnum in (NaWR)") -> (IsWindow?=w4, hWnd out=w5)
      case (w4) {
        frame 0 {
          w6 = 6003  # Window Not Found
          Property Node(instance in=$"error in", "status"=TRUE, "code"=w6, "source"="Get Window Name.vi") -> (instance out=w1)
          w2 = default
          w3 = default
        }
        frame Default {
          call "GetWindowTextLengthA"(hWnd in=w5) -> (length=w7, hWnd out=w8)
          call "Generate String Buffer.gvi"(buffer size=w7) -> (string buffer=w9)
          call "GetWindowTextA"(hWnd in=w8, NameBuffer in=w9, MaxCharsToCopy in=w7) -> (hWnd out=w3, NameBuffer out=w2)
          w1 = $"error in"
        }
      }
    }
    frame Error {
      w1 = $"error in"
      w2 = default
      w3 = $"window refnum in (NaWR)"
    }
  }
  $"window refnum out" <- w3
  $"window name" <- w2
  $"error out" <- w1
