vi "Get Window Rectangle.gvi"   [LabVIEW Conversion 5.1.0]
# This VI will find the coordinates of the upper left and lower right corners of the window identified by the 'window refnum' parameter.  Coordinate values are in pixels, relative to the upper left corner of the screen.  The 'window refnum' can be obtained by using 'Get Window RefNum.vi'.
inputs:
  "window refnum (NaWR)": u64  # The window refnum in identifies the window whose size is to be retrieved.
  "error in": error
outputs:
  "window refnum out": u64  # window refnum out is the same as window refnum in if window refnum in is valid. If an error occured, window refnum out is invalid.
  "window rect": T1
  "error out": error
types:
  T1 = cluster{"left": i16, "top": i16, "right": i16, "bottom": i16}
  T2 = cluster{"RECT[0]": i32, "RECT[1]": i32, "RECT[2]": i32, "RECT[3]": i32}
uses:
  Main::user32.sli::GetWindowRect
  Main::kernel32.sli::GetLastError
diagram:
  # use subroutine priority to allow correct use of GetLastError()
  case ($"error in") {
    frame No Error {
      Initialize Array(element=0, size=4) -> w4
      call "GetWindowRect"(hWnd in=$"window refnum (NaWR)", RECT in=w4) -> (Return Value=w5, hWnd out=w1, RECT out=w6)
      case (w5) {
        frame 0 {
          call "GetLastError"() -> (return type=w7)
          Property Node(instance in=$"error in", "status"=TRUE, "code"=w7, "source"="Get Window Rectangle.vi") -> (instance out=w2)
          w3 = default
        }
        frame Default {
          Array To Cluster[NumberOfClusterElements=4](array=w6) -> (cluster=w8)
          Coerce To Type(type=T2 {all zero or empty}, x=w8) -> w3
          w2 = $"error in"
        }
      }
    }
    frame Error {
      w1 = $"window refnum (NaWR)"
      w2 = $"error in"
      w3 = default
    }
  }
  $"window refnum out" <- w1
  $"window rect" <- w3
  $"error out" <- w2
