vi "Get Window RefNum.gvi"   [LabVIEW NXG 5.1.0]
# This VI  will use the FindWindow API function to retrieve a window refnum for the window identified by window name.  'window name' is the text appearing in the title bar of a window.  If the window cannot be found, the window refnum out will be 'Not a Window Refnum', and an error will occur.
inputs:
  "window name (\"\")": string
  "error in": error
outputs:
  "window refnum (NaWR)": u64
  "error out": error
uses:
  Main::Not a Window Refnum.gvi
  Main::user32.sli::FindWindowA
diagram:
  call "Not a Window Refnum.gvi"() -> (Not a Window Refnum=w1)
  case ($"error in") {
    frame No Error {
      case ($"window name (\"\")") {
        frame Default {
          call "FindWindowA"(lpszClassName in=0, lpszWindowName in=$"window name (\"\")") -> (hWnd=w3)
          Is Equal To 0(x=w3) -> w4
          Select(s=w4, t=6002, f=0) -> w5
        }
        frame "" {
          w3 = w1
          w4 = TRUE
          w5 = 6001
        }
      }
      Property Node(instance in=$"error in", "status"=w4, "code"=w5, "source"="Get Window RefNum.vi") -> (instance out=w2)
    }
    frame Error {
      w2 = $"error in"
      w3 = w1
    }
  }
  $"window refnum (NaWR)" <- w3
  $"error out" <- w2
