vi "Hide Window.gvi"   [LabVIEW NXG 5.1.0]
# This function will hide the window named in the 'window name' input if 'window refnum' is not valid. Otherwise it uses 'window refnum' to identify the window.  If the window cannot be found, an error will be returned.  If the winodw name is used to identify the window instead, then 'window refnum out' will contain the window refnum for the window that was hidden if the function was successful.
inputs:
  "window refnum": u64  # Identifies the window to be hidden. If not valid, the window name input is used.
  "window name (\"\")": string
  "error in": error
outputs:
  "window refnum out": u64  # Identifies the window that was hidden.
  "error out": error
uses:
  Main::Get Window RefNum.gvi
  Main::Control Window.gvi
diagram:
  case ($"window refnum") {
    frame Default {
      w1 = $"window refnum"
      w2 = $"error in"
    }
    frame 0 {
      call "Get Window RefNum.gvi"(window name ("")=$"window name (\"\")", error in=$"error in") -> (window refnum (NaWR)=w1, error out=w2)
    }
  }
  call "Control Window.gvi"(window refnum=w1, Function="SW_HIDE", error in=w2) -> (dup window refnum=w3, error out=w4)
  $"window refnum out" <- w3
  $"error out" <- w4
