vi "Maximize Window.gvi"   [LabVIEW NXG 5.1.0]
# This function will  maximize the window named in the window name input, or identified by the window refnum.  If an invalid window refnum is passed in, then the function will use the window name to get a window window refnum.  If the window cannot be found, an error will be returned.
inputs:
  "window refnum (NaWR)": u64  # Identifies the window to be maximized. If not valid, the window name input is used.
  "window name (\"\")": string
  "error in": error
outputs:
  "window refnum out": u64  # Identifies the window that was maximized.
  "error out": error
uses:
  Main::Get Window RefNum.gvi
  Main::Control Window.gvi
diagram:
  case ($"window refnum (NaWR)") {
    frame Default {
      w1 = $"window refnum (NaWR)"
      w2 = $"error in"
    }
    frame 0 {
      call "Get Window RefNum.gvi"(window name ("")=$"window name (\"\")", error in=$"error in") -> (window refnum (NaWR)=w1, error out=w2)
    }
  }
  call "Control Window.gvi"(window refnum=w1, Function="SW_MAXIMIZE", error in=w2) -> (dup window refnum=w3, error out=w4)
  $"window refnum out" <- w3
  $"error out" <- w4
