vi "Move Window to Bottom.gvi"   [LabVIEW NXG 5.1.0]
# This function will  make the window named in the 'window name' input, or identified by the 'window refnum', the bottom-most window, placing it behind all other windows. If sent to a VI window, the next task in the Windows Task List will come to the foreground.
# If 'not a window refnum' is passed in, then the function will use the window name to get a window window refnum.  If the window cannot be found, an error will be returned.
inputs:
  "window refnum": u64  # Identifies the window to be moved to the bottom. If not valid, the window name input is used.
  "window name (\"\")": string
  "error in": error
outputs:
  "window refnum out": u64  # Identifies the window that was moved to the bottom.
  "error out": error
uses:
  Main::Get Window RefNum.gvi
  Main::Set Window Z-Position.gvi
diagram:
  case ($"window refnum") {
    frame Default {
      w1 = $"window refnum"
      w2 = $"error in"
    }
    frame 0 {
      call "Get Window RefNum.gvi"(window name ("")=$"window name (\"\")", error in=$"error in") -> (window refnum (NaWR)=w1, error out=w2)
    }
  }
  call "Set Window Z-Position.gvi"(window refnum=w1, z-order position="Bottom"(3), activate? (T)=FALSE, error in=w2) -> (window refnum out=w3, error out=w4)
  $"window refnum out" <- w3
  $"error out" <- w4
