vi "Move Window to Topmost.gvi"   [LabVIEW NXG 5.1.0]
# This function will  make the window named in the 'window name' input, or identified by the 'window refnum' the top window, and activate it (default case).  If 'not a window refnum' is passed in, then the function will use the window name to get a window window refnum.  If the window cannot be found, an error will be returned.
inputs:
  "window refnum": u64  # Identifies the window to be made the top window. If not valid, the window name input is used.
  "window name (\"\")": string
  "activate? (T)": bool = TRUE  # Controls whether or not the window will be activated when it's z-order position is changed.
  "error in": error
outputs:
  "window refnum out": u64  # Identifies the window that was moved on top.
  "error out": error
uses:
  Main::Get Window RefNum.gvi
  Main::Set Window Z-Position.gvi
  Main::user32.sli::SetForegroundWindow
diagram:
  case ($"window refnum") {
    frame Default {
      w1 = $"window refnum"
      w2 = $"error in"
    }
    frame 0 {
      call "Get Window RefNum.gvi"(window name ("")=$"window name (\"\")", error in=$"error in") -> (window refnum (NaWR)=w1, error out=w2)
    }
  }
  call "Set Window Z-Position.gvi"(window refnum=w1, z-order position="Top"(2), activate? (T)=$"activate? (T)", error in=w2) -> (window refnum out=w3, error out=w4)
  call "SetForegroundWindow"(hvnd in=w3)
  $"window refnum out" <- w3
  $"error out" <- w4
