vi "Move Window.gvi"   [LabVIEW NXG 5.1.0]
# This function will  move the window named in the 'window name' input or identified by the 'window refnum' from its present location to that defined in the 'new position' cluster.  Coordinates are pixels relative to upper left corner of the screen.
# If the function is successful, then:
# 'window refnum out' = 'window refnum' if window refnum in is valid;
# 'window refnum out' is a new window refnum if 'window refnum' is not valid and 'window name' a valid name for a window.
# If the window cannot be found, an error will be returned and window refnum out will be 'Not a Valid Window RefNum'.
inputs:
  "window refnum": u64  # The window refnum in identifies the window that is to be moved.
  "window name (\"\")": string
  "new position (0,0)": cluster{"left": i16, "top": i16}
  "error in": error
outputs:
  "window refnum out": u64  # window refnum out is the same as window refnum in if window refnum in is valid. If an error occured, window refnum out is invalid.
  "prev position": cluster{"left": i16, "top": i16}
  "error out": error
uses:
  Main::Get Window RefNum.gvi
  Main::Get Window Rectangle.gvi
  Main::Extract Window Origin - Size.gvi
  Main::user32.sli::MoveWindow
diagram:
  case ($"window refnum") {
    frame Default {
      w1 = $"window refnum"
      w2 = $"error in"
    }
    frame 0 {
      call "Get Window RefNum.gvi"(window name ("")=$"window name (\"\")", error in=$"error in") -> (window refnum (NaWR)=w1, error out=w2)
    }
  }
  call "Get Window Rectangle.gvi"(window refnum (NaWR)=w1, error in=w2) -> (window refnum out=w3, window rect=w4, error out=w5)
  case (w5) {
    frame No Error {
      To Signed 32 Bit Integer(number=$"new position (0,0)") -> w9
      Property Node(instance in=w9) -> ("left"=w10, "top"=w11)
      call "Extract Window Origin - Size.gvi"(window rect=w4) -> (window origin=w8, window size=w12)
      To Signed 32 Bit Integer(number=w12) -> w13
      Property Node(instance in=w13) -> ("Width"=w14, "Height"=w15)
      w16 = TRUE  # repaint
      Boolean To 0 Or 1(Boolean=w16) -> (0, 1=w17)
      To Signed 32 Bit Integer(number=w17) -> w18
      call "MoveWindow"(hWnd in=w3, left in=w10, top in=w11, right in=w14, bottom in=w15, repaint in=w18) -> (error_2=w19, hWnd out=w20)
      case (w19) {
        frame Default {
          w6 = w5
          w7 = w20
        }
        frame 0 {
          Property Node(instance in=w5, "status"=TRUE, "code"=6021, "source"="Move Window.vi") -> (instance out=w6)
          w7 = default
        }
      }
    }
    frame Error {
      w6 = w5
      w7 = w3
      w8 = $"new position (0,0)"
    }
  }
  $"prev position" <- w8
  $"window refnum out" <- w7
  $"error out" <- w6
