vi "PostMessage Master.gvi"   [LabVIEW Conversion 5.1.0]
# This VI acts as a "Master" for various VIs that use the LVPostMessage function in the LVWUTIL.DLL library.  This is basically just the PostMessage API function with a WM_SYSCOMMAND message, but also does some additional checking for the existance of the targeted window.
inputs:
  "window refnum": u64  # The window refnum identifies the main window of the application to be closed. If it is not valid, the function will use the window name input to get a window refnum (if the window name is valid).
  "Function": T1 = "Maximize Window"
  "error in": error
outputs:
  "window refnum out": u64  # Identifies the window that was hidden.
  "error out": error
types:
  T1 = enum{"Maximize Window", "Minimize Window", "Show Task List", "Start Screen Saver", "Quit Application"}
uses:
  Main::user32.sli::IsWindow
  Main::user32.sli::GetWindow
  Main::user32.sli::GetParent
  Main::user32.sli::PostMessageA
diagram:
  case ($"error in") {
    frame No Error {
      call "IsWindow"(hWnd in=$"window refnum") -> (IsWindow?=w3, hWnd out=w4)
      case (w3) {
        frame 0 {
          w2 = w4
          w5 = 6002
          w6 = TRUE
        }
        frame Default {
          case ($Function) {
            frame "Quit Application" {
              w12 = 4  # GW_OWNER
              call "GetWindow"(hWnd in=w4, uCmd in=w12) -> (return type=w13, hWnd out=w14)
              case (w13) {
                frame Default {
                  w9 = w14
                  w10 = TRUE
                  w11 = 6006
                }
                frame 0 {
                  call "GetParent"(hWnd in=w14) -> (return type=w15, hWnd out=w9)
                  Is Not Equal To 0(x=w15) -> w10
                  w11 = 6007
                }
              }
              w16 = 0x10  # WM_CLOSE
              w7 = w16
              w8 = default
            }
            frame "Maximize Window".."Start Screen Saver" {
              Array Index(array=[3843, 3842, 3859, 3860]) -> (out0[$Function]=w8)
              w17 = 0xF7  # WM_SYSCOMMAND
              w7 = w17
              w9 = w4
              w10 = default
              w11 = default
            }
          }
          case (w10) {
            frame False, Default {
              call "PostMessageA"(hWnd in=w9, Msg in=w7, wParam in=w8, lParam in=0) -> (error code=w18, hWnd out=w2)
              Is Equal To 0(x=w18) -> w6
              w5 = 6005
            }
            frame True {
              w5 = w11
              w6 = w10
              w2 = w9
            }
          }
        }
      }
      case (w6) {
        frame True {
          Property Node(instance in=$"error in", "status"=TRUE, "code"=w5, "source"="PostMessage Master.vi") -> (instance out=w1)
        }
        frame False {
          w1 = $"error in"
        }
      }
    }
    frame Error {
      w1 = $"error in"
      w2 = $"window refnum"
    }
  }
  $"window refnum out" <- w2
  $"error out" <- w1
