vi "Redraw Window.gvi"   [LabVIEW Conversion 5.1.0]
inputs:
  "window refnum": u64
  "error in": error
outputs:
  "window refnum out": u64
  "error out": error
uses:
  Main::user32.sli::SetWindowPos
diagram:
  case ($"error in") {
    frame No Error {
      w3 = 0x20  # SWP_FRAMECHANGED
      w4 = 0x2  # SWP_NOMOVE
      w5 = 0x1  # SWP_NOSIZE
      Logical Or(w4, w5, w3) -> w6
      call "SetWindowPos"(hWnd in=$"window refnum", hWndInsertAfter in=0, left in=0, top in=0, width in=0, height in=0, fuFlags in=w6) -> (error_2=w7, hWnd out=w2)
      case (w7) {
        frame 0 {
          w1 = $"error in"
        }
        frame Default {
          Property Node(instance in=$"error in", "status"=TRUE, "code"=6030, "source"="Redraw Window.vi") -> (instance out=w1)
        }
      }
    }
    frame Error {
      w1 = $"error in"
      w2 = $"window refnum"
    }
  }
  $"window refnum out" <- w2
  $"error out" <- w1
