vi "Rename Window.gvi"   [LabVIEW NXG 5.1.0]
# This VI will rename the window identified either by its title or by its window refnum.  If the window refnum is supplied, the name of the window before renaming is returned in the 'prev window name' output.  If the window name is used to identify the window (current window name), then 'prev window name' =  'current window name'.
inputs:
  "window refnum": u64  # Identifies the window to be renamed. If not valid, the current window name input is used.
  "current window name (\"\")": string
  "new window name (\"\")": string
  "error in": error
outputs:
  "window refnum out": u64  # Identifies the window that was renamed.
  "prev window name": string
  "error out": error
uses:
  Main::Get Window Name.gvi
  Main::Get Window RefNum.gvi
  Main::user32.sli::SetWindowTextA
diagram:
  case ($"window refnum") {
    frame Default {
      call "Get Window Name.gvi"(window refnum in (NaWR)=$"window refnum", error in=$"error in") -> (window refnum out=w1, window name=w3, error out=w2)
    }
    frame 0 {
      call "Get Window RefNum.gvi"(window name ("")=$"current window name (\"\")", error in=$"error in") -> (window refnum (NaWR)=w1, error out=w2)
      w3 = $"current window name (\"\")"
    }
  }
  case (w2) {
    frame No Error {
      case ($"new window name (\"\")") {
        frame Default {
          call "SetWindowTextA"(hWnd in=w1, windowName in=$"new window name (\"\")") -> (hWnd out=w4)
          w6 = w2
        }
        frame "" {
          Property Node(instance in=w2, "status"=TRUE, "code"=6001, "source"="Rename Window.vi") -> (instance out=w6)
          w4 = w1
        }
      }
      w5 = w3
    }
    frame Error {
      w4 = w1
      w5 = ""
      w6 = w2
    }
  }
  $"prev window name" <- w5
  $"window refnum out" <- w4
  $"error out" <- w6
