vi "Resize Window.gvi"   [LabVIEW NXG 5.1.0]
# This function will  resize (without moving) the window named in the window name input or identified by the window refnum.  Window size is determined in pixels.  If the window cannot be found, an error will be returned.
inputs:
  "window refnum": u64  # The window refnum in identifies the window that is to be resized.
  "window name (\"\")": string
  "new Size": cluster{"Width": i32, "Height": i32}
  "error in": error
outputs:
  "window refnum out": u64  # window refnum out is the same as window refnum in if window refnum in is valid. If an error occured, window refnum out is invalid.
  "prev size": cluster{"Width": i16, "Height": i16}
  "error out": error
uses:
  Main::Get Window RefNum.gvi
  Main::Get Window Rectangle.gvi
  Main::Extract Window Origin - Size.gvi
  Main::user32.sli::MoveWindow
diagram:
  case ($"window refnum") {
    frame Default {
      w1 = $"window refnum"
      w2 = $"error in"
    }
    frame 0 {
      call "Get Window RefNum.gvi"(window name ("")=$"window name (\"\")", error in=$"error in") -> (window refnum (NaWR)=w1, error out=w2)
    }
  }
  call "Get Window Rectangle.gvi"(window refnum (NaWR)=w1, error in=w2) -> (window refnum out=w3, window rect=w4, error out=w5)
  case (w5) {
    frame No Error {
      Property Node(instance in=$"new Size") -> ("Width"=w9, "Height"=w10)
      w11 = TRUE  # repaint
      Boolean To 0 Or 1(Boolean=w11) -> (0, 1=w12)
      call "Extract Window Origin - Size.gvi"(window rect=w4) -> (window origin=w13, window size=w8)
      To Signed 32 Bit Integer(number=w13) -> w14
      Property Node(instance in=w14) -> ("left"=w15, "top"=w16)
      call "MoveWindow"(hWnd in=w3, left in=w15, top in=w16, right in=w9, bottom in=w10, repaint in=w12) -> (error_2=w17, hWnd out=w18)
      case (w17) {
        frame Default {
          w6 = w5
          w7 = w18
        }
        frame 0 {
          Property Node(instance in=w5, "status"=TRUE, "code"=6020, "source"="Resize Window.vi") -> (instance out=w6)
          w7 = default
        }
      }
    }
    frame Error {
      w6 = w5
      w7 = w3
      w8 = $"new Size"
    }
  }
  $"prev size" <- w8
  $"window refnum out" <- w7
  $"error out" <- w6
