vi "Restore Window.gvi"   [LabVIEW NXG 5.1.0]
# This function will  restore the window named in the window name input if the window refnum supplied is invalid, otherwise it uses window refnum to determine which window is restored.  If the window cannot be found, an error will be returned.
inputs:
  "window refnum (NaWR)": u64  # Identifies the window to be restored. If not valid, the window name input is used.
  "window name (\"\")": string
  "error in": error
outputs:
  "window refnum out": u64  # Identifies the window that was restored.
  "error out": error
uses:
  Main::Get Window RefNum.gvi
  Main::Control Window.gvi
diagram:
  case ($"window refnum (NaWR)") {
    frame Default {
      w1 = $"window refnum (NaWR)"
      w2 = $"error in"
    }
    frame 0 {
      call "Get Window RefNum.gvi"(window name ("")=$"window name (\"\")", error in=$"error in") -> (window refnum (NaWR)=w1, error out=w2)
    }
  }
  call "Control Window.gvi"(window refnum=w1, Function="SW_RESTORE", error in=w2) -> (dup window refnum=w3, error out=w4)
  $"window refnum out" <- w3
  $"error out" <- w4
