vi "Revoke Window Always on Top.gvi"   [LabVIEW NXG 5.1.0]
# This function will  revoke the topmost status of the window named in the 'window name' input, or identified by the 'window refnum' the topmost window, so it will no longer always be on top of other 'normal' windows. The action is ignored if the window is not a topmost window. If 'not a window refnum' is passed in, then the function will use the window name to get a window window refnum.  If the window cannot be found, an error will be returned.
inputs:
  "window refnum": u64  # Identifies the window whose topmost status is to be revoked. If not valid, the window name input is used.
  "window name (\"\")": string
  "activate? (F)": bool  # Controls whether or not the window will be activated when it's z-order position is changed.
  "error in": error
outputs:
  "window refnum out": u64  # Identifies the window whos topmost status was revoked.
  "error out": error
uses:
  Main::Get Window RefNum.gvi
  Main::Set Window Z-Position.gvi
diagram:
  case ($"window refnum") {
    frame Default {
      w1 = $"window refnum"
      w2 = $"error in"
    }
    frame 0 {
      call "Get Window RefNum.gvi"(window name ("")=$"window name (\"\")", error in=$"error in") -> (window refnum (NaWR)=w1, error out=w2)
    }
  }
  call "Set Window Z-Position.gvi"(window refnum=w1, z-order position="Not Topmost"(0), activate? (T)=$"activate? (F)", error in=w2) -> (window refnum out=w3, error out=w4)
  $"window refnum out" <- w3
  $"error out" <- w4
