vi "Set Window Z-Position.gvi"   [LabVIEW NXG 5.1.0]
inputs:
  "window refnum": u64
  "z-order position": u16 = "Not Topmost"(0)
  "activate? (T)": bool = TRUE  # Controls whether or not the window will be activated when it's z-order position is changed.
  "error in": error
outputs:
  "window refnum out": u64
  "error out": error
uses:
  Main::user32.sli::SetWindowPos
diagram:
  case ($"error in") {
    frame No Error {
      Subtract(x=$"z-order position", y=2) -> w3
      w4 = 0x10  # SWP_NOACTIVATE
      Select(s=$"activate? (T)", t=0x0, f=w4) -> w5
      w6 = 0x40  # SWP_SHOWWINDOW
      w7 = 0x2  # SWP_NOMOVE
      w8 = 0x1  # SWP_NOSIZE
      Logical Or(w7, w8) -> w9
      Logical Or(w9, w6) -> w10
      Logical Or(w10, w5) -> w11
      call "SetWindowPos"(hWnd in=$"window refnum", hWndInsertAfter in=w3, left in=0, top in=0, width in=0, height in=0, fuFlags in=w11) -> (error_2=w12, hWnd out=w2)
      case (w12) {
        frame 0 {
          Property Node(instance in=$"error in", "status"=TRUE, "code"=6030, "source"="Set Window Z-Position.vi") -> (instance out=w1)
        }
        frame Default {
          w1 = $"error in"
        }
      }
    }
    frame Error {
      w1 = $"error in"
      w2 = $"window refnum"
    }
  }
  $"error out" <- w1
  $"window refnum out" <- w2
