vi "Show Window.gvi"   [LabVIEW NXG 5.1.0]
# This function will show a previously hidden window. The window named in the 'window name' input is used to identify the target window if 'window refnum' is invalid.  If the window cannot be found, an error will be returned and 'window refnum out' will be invalid.
inputs:
  "window refnum": u64  # Identifies the window to be shown. If not valid, the window name input is used.
  "window name (\"\")": string
  "error in": error
outputs:
  "window refnum out": u64  # Identifies the window that was shown.
  "error out": error
uses:
  Main::Get Window RefNum.gvi
  Main::Control Window.gvi
diagram:
  case ($"window refnum") {
    frame Default {
      w1 = $"window refnum"
      w2 = $"error in"
    }
    frame 0 {
      call "Get Window RefNum.gvi"(window name ("")=$"window name (\"\")", error in=$"error in") -> (window refnum (NaWR)=w1, error out=w2)
    }
  }
  call "Control Window.gvi"(window refnum=w1, Function="SW_SHOW", error in=w2) -> (dup window refnum=w3, error out=w4)
  $"window refnum out" <- w3
  $"error out" <- w4
