vi "iSRB.gvi"   [LabVIEW NXG 5.1.0]
panel controls:
  "File Path": path = path "C:\\Users"  # is the complete pathname, including drive, directory, and filename, of the file to read.
  "Parameters": "SRb Params.gtype" = {"UpSampling"=4, "First Visible"=0, "Auto Rotate"=TRUE}
  "Open Image": bool
  "MEASURE": bool
  "Stop": bool
  "Open": bool
  "Power Button": bool
  "Measure_2": bool
panel indicators:
  "Image": "Vision IMAQImage"
  "Interpolation Graph": T1[]
  "resulting string": string
  "resulting string 2": string
  "Line Profile": f32[]
  "Buzy": bool
  "Loaded": bool
  "version": string
types:
  "SRb Params.gtype" = cluster{"UpSampling": i32, "First Visible": u16, "Auto Rotate": bool}
  T1 = cluster{"Element 1": cluster{"Dip": f64, "Dip %": f64}[]}
  T2 = cluster{"ID": enum{"External", "Internal"}, "Type": u32, "Coordinates": i32[]}
  "ROI Descriptor.gtype" = cluster{"Global Rectangle": i32[], "Contours": T2[]}
  T3 = cluster{"Name": string, "Color": u32, "Style": u8, "Point Style": u8, "Name Visible": bool, "Allow Drag": bool, "Cursor Mode": u32, "Plot": i32, "Index": i32, "Position": cluster{"X": f64, "Y": f64}, "X Scale": u32, "Y Scale": u32, "Watch Plots": i32[], "Watch All Plots": bool, "Plot Area": i32, "Label Offset": cluster{"X": f64, "Y": f64}}
uses:
  NI::G Core::File IO (General)::Get System Directory.gvi
  NI::Vision::Core::Basics::Create Image.gvi
  NI::G Core::File IO (General)::File Version Information.gvi
  NI::Vision::Core::Files::Read Image File.gvi
  NI::G Core::Error::Display Error.gvi
  NI::G Core::Operating System::Write to System Log.gvi
  NI::Vision::Core::Overlay::Clear Overlay.gvi
  My Computer::Module SRb - Core.gvi
  NI::Vision::Core::Overlay::Overlay Multiple Lines.gvi
  NI::Vision::Core::Files::Load Image Dialog.gvi
diagram:
  s1 = uninitialised  # shift register
  for (N = 3) (iteration -> i1) {
    case (i1) {
      frame 0, Default {
        call "Get System Directory.gvi"(type="User Desktop") -> (system directory=w2)
        $"File Path" <- w2
        Property Node(instance in=reference to "Image", "ROI"="ROI Descriptor.gtype" {all zero or empty})
        $"resulting string" <- ""
        $Loaded <- FALSE
        call "Create Image.gvi"(image name="iSRB", image type="Grayscale (U16)"(7)) -> (new image=w3)
        Build Cluster(w3, $"File Path") -> w1
        Get Component Directory() -> (Path=w4)
        Strip Path(path=w4)
        Build Path(base path=w4, name or relative path="iSRB Measurement.exe") -> (appended path=w5)
        call "File Version Information.gvi"(executable or DLL=w5) -> (file version=w6, error out=w7)
        case (w7) {
          frame Error, Default {
            w8 = "Dev"
          }
          frame No Error {
            w8 = w6
          }
        }
        $version <- w8
      }
      frame 1 {
        s2 = s1  # shift register
        while {
          event (timeout = 50) {
            on "Timeout" {
              Property Node(instance in=reference to "Image") -> ("ROI"=w11)
              Property Node(instance in=w11) -> ("Contours"=w12)
              Array Index(array=w12) -> (out0[_]=w13)
              Property Node(instance in=w13) -> ("Type"=w14)
              Is Equal(x=w14, y=12) -> w15
              Logical And($Loaded, w15) -> w16
              Not(x=w16) -> w17
              Property Node(instance in=reference to "MEASURE", "Disabled"=w17)
              w9 = default
              w10 = s2
            }
            on "Stop" Value changed {
              w9 = $Stop
              w10 = s2
            }
            on "Open Image" Value changed {
              Property Node(instance in=s2) -> ("Element 1"=w18, "Element 2"=w19, instance out=w20)
              call "Read Image File.gvi"(image in=w18, file path=w19) -> (image out=w21, error out=w22)
              Property Node(instance in=w20, "Element 1"=w21) -> (instance out=w10)
              $Image <- w21
              case (w22) {
                frame Error, Default {
                  call "Display Error.gvi"(error in=w22)
                }
                frame No Error {
                  $Loaded <- TRUE
                }
              }
              w9 = default
            }
            on "MEASURE" Value changed {
              call "Write to System Log.gvi"(message="MEASURE", severity="Informational"(2))
              $Buzy <- TRUE
              Property Node(instance in=reference to "Image") -> ("ROI"=w23)  # Vision Image Display properties
              Property Node(instance in=s2) -> ("Element 1"=w24, instance out=w10)
              call "Clear Overlay.gvi"(image in=w24) -> (image out=w25)
              call "Module SRb - Core.gvi"(Parameters=$Parameters, Image=w25, ROI Descriptor=w23) -> (SRb Graphs=w26, Rectangle Points=w27)
              Property Node(instance in=w26) -> ("Line Profile"=w28)
              $"Line Profile" <- w28
              Property Node(instance in=w26) -> ("Polynom String"=w29, "SRb"=w30, "Interpolation Graph"=w31)
              Property Node(instance in=T3 {all zero or empty}, "Name"="SRB", "Position:X"=w30, "Position:Y"=20, "Plot"=0, "Color"=0, "Style"=8) -> (instance out=w32)
              Build Array(w32) -> w33
              Property Node(instance in=reference to "Interpolation Graph") -> ("Cursor"=w34, instance out=w35)
              Property Node(instance in=w34, "Name"="SRB", "Visible"=TRUE, "XPosition"=w30, "YPosition"=20) -> (instance out=w36)
              sequence (after w35) (after w33) (after w36) {
                frame 0 {
                  # cursors list
                  $Buzy <- FALSE
                }
              }
              Number To Fractional String(number=w30, precision (6)=1) -> (F-format string=w37)
              $"resulting string 2" <- w37
              $"resulting string" <- w29
              $"Interpolation Graph" <- w31
              call "Overlay Multiple Lines.gvi"(color=4294901760, image in=w25, line endpoints=w27) -> (image out=w38)
              $Image <- w38
              w9 = default
            }
            on "Application menu" Menu selection (User) {
              Event Data() -> ("ItemTag"=w39)
              case (w39) {
                frame Default {
                  One Button Dialog(message=w39)
                  w10 = s2
                }
                frame "_Open..." {
                  Property Node(instance in=s2) -> ("Element 1"=w40, instance out=w41)
                  call "Get System Directory.gvi"(type="User Desktop") -> (system directory=w42)
                  call "Load Image Dialog.gvi"(start path=w42) -> (selected path=w43, cancelled?=w44)
                  case (w44) {
                    frame True {
                      # cancelled...
                      w10 = w41
                    }
                    frame False {
                      call "Read Image File.gvi"(image in=w40, file path=w43) -> (image out=w45, error out=w46)
                      Property Node(instance in=w41, "Element 1"=w45) -> (instance out=w10)
                      $Image <- w45
                      case (w46) {
                        frame Error, Default {
                          call "Display Error.gvi"(error in=w46)
                        }
                        frame No Error {
                          $Loaded <- TRUE
                        }
                      }
                    }
                  }
                }
              }
              w9 = default
            }
          }
          next s2 = w10
          stop if w9
        }
        w1 = s2
      }
      frame 2 {
        w1 = s1
      }
    }
    next s1 = w1
  }
