vi "iSRb - Compute Dips Percentages.gvi"   [LabVIEW NXG 5.1.0]
inputs:
  "iSRb in": "iSRb.gtype", required
  "error in (no error)": error
outputs:
  "iSRb out": "iSRb.gtype"
  "Dips": "Dip TypeDef.gtype"[]
  "error out": error
types:
  "Dip TypeDef.gtype" = cluster{"Dip Nr": i32, "Dip Res": f64, "Dip Start": f64, "Dip End": f64, "Valley A Location": f64, "Valley A Amplitude": f64, "Valley A 2nd Derivative": f64, "Valley C Location": f64, "Valley C Amplitude": f64, "Valley C 2nd Derivative": f64, "Peak B Location": f64, "Peak B Amplitude": f64, "Peak B 2nd Derivative": f64, "Dip %": f64, "Double Dip": bool}
  T1 = cluster{"Valley A Location": f64, "Valley A Amplitude": f64}
  T2 = cluster{"Element 1": cluster{"Dip Start": f64, "mean": f32}, "Element 2": cluster{"Dip End": f64, "mean": f32}}
  T3 = cluster{"Element 1": T1, "Element 2": cluster{"Valley A Location": f64, "mean": f32}}
  T4 = cluster{"Valley C Location": f64, "Valley C Amplitude": f64}
  T5 = cluster{"Element 1": T4, "Element 2": cluster{"Valley C Location": f64, "mean": f32}}
  T6 = cluster{"Peak B Location": f64, "Peak B Amplitude": f64}
  T7 = cluster{"Element 1": T6, "Element 2": cluster{"Peak B Location": f64, "mean": f32}}
uses:
  NI::G Core::Operating System::Write to System Log.gvi
  NI::Vision::Algorithms::Analytic::Lines Intersection.gvi
  NI::Vision::Algorithms::Analytic::Point Distances.gvi
  NI::G Core::Error::Legacy::Clear Errors.gvi
diagram:
  call "Write to System Log.gvi"(message="% Intersections", severity="Informational"(2))
  case ($"error in (no error)") {
    frame No Error {
      Property Node(instance in=$"iSRb in") -> ("Profile"=w4, "Dips"=w5)
      for {
        w6 = each element of w5
        Property Node(instance in=w6) -> ("Double Dip"=w7)
        case (w7) {
          frame False, Default {
            w8 = 0
          }
          frame True {
            Property Node(instance in=w6) -> ("Dip Start"=w9, "Dip End"=w10, "Valley A Location"=w11, "Valley A Amplitude"=w12, "Valley C Location"=w13, "Valley C Amplitude"=w14, "Peak B Location"=w15, "Peak B Amplitude"=w16)
            Property Node(instance in=T1 {all zero or empty}, "Valley A Location"=w11, "Valley A Amplitude"=w12) -> (instance out=w17)
            Array Index(array=w4) -> (out0[w9]=w18, out1[w10]=w19)
            Property Node(instance in=cluster{"Dip Start": f64, "mean": f32} {all zero or empty}, "Dip Start"=w9, "mean"=w18) -> (instance out=w20)
            Property Node(instance in=cluster{"Dip End": f64, "mean": f32} {all zero or empty}, "Dip End"=w10, "mean"=w19) -> (instance out=w21)
            # Valley A
            Property Node(instance in=T2 {all zero or empty}, "Element 1"=w20, "Element 2"=w21) -> (instance out=w22)
            Property Node(instance in=w20) -> ("mean"=w23)
            Property Node(instance in=w17) -> ("Valley A Location"=w24)
            w25 = cluster{"Valley A Location": f64, "mean": f32} {all zero or empty}
            Property Node(instance in=w25, "Valley A Location"=w24, "mean"=w23) -> (instance out=w26)
            Property Node(instance in=T3 {all zero or empty}, "Element 1"=w17, "Element 2"=w26) -> (instance out=w27)
            call "Lines Intersection.gvi"(line 1=w22, line 2=w27) -> (intersection point=w28)
            Build Array(w28, w17) -> w29
            Coerce To Type(type=T1[] [], x=w29) -> w30
            call "Point Distances.gvi"(points=w30) -> (distances=w31)
            Array Index(array=w31) -> (out0[_]=w32)
            Property Node(instance in=T4 {all zero or empty}, "Valley C Location"=w13, "Valley C Amplitude"=w14) -> (instance out=w33)
            Property Node(instance in=w33) -> ("Valley C Location"=w34)
            w35 = cluster{"Valley C Location": f64, "mean": f32} {all zero or empty}
            Property Node(instance in=w35, "Valley C Location"=w34, "mean"=w23) -> (instance out=w36)
            # Valley B
            Property Node(instance in=T5 {all zero or empty}, "Element 1"=w33, "Element 2"=w36) -> (instance out=w37)
            call "Lines Intersection.gvi"(line 1=w22, line 2=w37) -> (intersection point=w38)
            Build Array(w38, w33) -> w39
            Coerce To Type(type=T4[] [], x=w39) -> w40
            call "Point Distances.gvi"(points=w40) -> (distances=w41)
            Array Index(array=w41) -> (out0[_]=w42)
            Property Node(instance in=T6 {all zero or empty}, "Peak B Location"=w15, "Peak B Amplitude"=w16) -> (instance out=w43)
            Property Node(instance in=w43) -> ("Peak B Location"=w44)
            w45 = cluster{"Peak B Location": f64, "mean": f32} {all zero or empty}
            Property Node(instance in=w45, "Peak B Location"=w44, "mean"=w23) -> (instance out=w46)
            Property Node(instance in=T7 {all zero or empty}, "Element 1"=w43, "Element 2"=w46) -> (instance out=w47)
            # Peak C
            call "Lines Intersection.gvi"(line 1=w22, line 2=w47) -> (intersection point=w48)
            Build Array(w48, w43) -> w49
            Coerce To Type(type=T6[] [], x=w49) -> w50
            call "Point Distances.gvi"(points=w50) -> (distances=w51)
            Array Index(array=w51) -> (out0[_]=w52)
            C Code Node("A"=w32, "B"=w42, "C"=w52) -> ("Dip"=w8, Error Out=w53)
            ~~~
            // REVIEW

            // Code in a Formula Node was converted to code in a C Node.
            // Review the converted code to ensure it has the same behavior
            // as the original code.


            // ORIGINAL CODE:

            // Dip=100*(A+B-2*C)/(A+B);


            // CONVERTED CODE:

            Dip=100*(A+B-2*C)/(A+B);
            ~~~
            call "Clear Errors.gvi"(error in=w53)
          }
        }
        Property Node(instance in=w6, "Dip %"=w8) -> (instance out=w54)
        append w54 to w3
      }
      Property Node(instance in=$"iSRb in", "Dips"=w3) -> (instance out=w2)
      w1 = $"error in (no error)"
    }
    frame Error {
      w1 = $"error in (no error)"
      w2 = $"iSRb in"
      w3 = default
    }
  }
  $"error out" <- w1
  $"iSRb out" <- w2
  $Dips <- w3
