vi "iSRb - Filter Valleys.gvi"   [LabVIEW NXG 5.1.0]
inputs:
  "iSRb in": "iSRb.gtype", required
  "error in (no error)": error
outputs:
  "iSRb out": "iSRb.gtype"
  "valid valleys": i32[]
  "error out": error
  "RAW Valleys Info.Amplitudes": f64[]
uses:
  NI::G Core::Operating System::Write to System Log.gvi
diagram:
  call "Write to System Log.gvi"(message="Val Filter", severity="Informational"(2))
  case ($"error in (no error)") {
    frame No Error {
      Property Node(instance in=$"iSRb in") -> ("RAW Valleys Info"=w3, "Profile"=w4)
      Property Node(instance in=w3) -> ("Amplitudes"=w5)
      $"RAW Valleys Info.Amplitudes" <- w5
      Array Max And Min(array=w4) -> (max value=w6, min value=w7)
      Subtract(x=w6, y=w7) -> w8
      Divide(x=w8, y=2) -> w9
      Add(w9, w7) -> w10
      s1 = w10  # shift register
      for (iteration -> i1) {
        w11 = each element of w5
        Is Less(x=w11, y=s1) -> w13
        case (w13) {
          frame False, Default {
            w14 = s1
          }
          frame True {
            Subtract(x=w6, y=w11) -> w15
            Divide(x=w15, y=2) -> w16
            Add(w16, w11) -> w14
          }
        }
        append i1 to w12 if w13
        next s1 = w14
      }
      # thr
      $"valid valleys" <- w12
      Property Node(instance in=$"iSRb in", "Valid Valleys Indexes"=w12) -> (instance out=w2)
      w1 = $"error in (no error)"
    }
    frame Error {
      w1 = $"error in (no error)"
      w2 = $"iSRb in"
    }
  }
  $"error out" <- w1
  $"iSRb out" <- w2
