vi "iSRb - Set Relative Angle.gvi"   [LabVIEW NXG 5.1.0]
inputs:
  "iSRb in": "iSRb.gtype", required
  "Angle": f64
  "error in (no error)": error
outputs:
  "iSRb out": "iSRb.gtype"
  "Rectangle Points": "Point Coordinates.gtype"[]  # Rectangle Points returns the actual coordinates of the summits of the rectangle.
  "ROI min(x,y)": i32
  "error out": error
types:
  "Point Coordinates.gtype" = cluster{"X": f32, "Y": f32}
uses:
  NI::G Core::Operating System::Write to System Log.gvi
  NI::Vision::Algorithms::ROI Conversion::Convert ROI to Rectangle.gvi
  NI::Vision::Algorithms::ROI Conversion::Convert Rectangle to ROI (Polygon).gvi
diagram:
  call "Write to System Log.gvi"(message="+- Angle", severity="Informational"(2))
  case ($"error in (no error)") {
    frame No Error {
      Property Node(instance in=$"iSRb in") -> ("ROI"=w6)
      Property Node(instance in=w6) -> ("Contours"=w7)
      Array Index(array=w7) -> (out0[_]=w8)
      Property Node(instance in=w8) -> ("Points"=w9)
      Array Index(array=w9) -> (out0[_]=w10, out1[_]=w11, out2[_]=w12, out3[_]=w13)
      Subtract(x=w10, y=w12) -> w14
      Absolute Value(x=w14) -> w5
      Subtract(x=w11, y=w13) -> w15
      Absolute Value(x=w15) -> w4
      Is Less(x=w5, y=w4) -> w16
      # bottom top to right left
      call "Convert ROI to Rectangle.gvi"(ROI descriptor=w6) -> (rectangle=w17)
      case (w16) {
        frame False, Default {
          Property Node(instance in=w17) -> ("Bottom"=w19, "Top"=w20, "Rotation"=w18)
        }
        frame True {
          Property Node(instance in=w17) -> ("Right"=w19, "Left"=w20, "Rotation"=w18)
        }
      }
      Add(w18, $Angle) -> w21
      Subtract(x=w19, y=w20) -> w22
      Multiply(w22, 0.2) -> w23
      Subtract(x=w19, y=w23) -> w24
      Add(w20, w23) -> w25
      case (w16) {
        frame True {
          Property Node(instance in=w17, "Right"=w24, "Left"=w25, "Rotation"=w21) -> (instance out=w26)
        }
        frame False {
          Property Node(instance in=w17, "Bottom"=w24, "Top"=w25, "Rotation"=w21) -> (instance out=w26)
        }
      }
      call "Convert Rectangle to ROI (Polygon).gvi"(rectangle=w26) -> (ROI descriptor=w27, rectangle points=w3)
      Property Node(instance in=$"iSRb in", "ROI"=w27, "Rectangle Points"=w3, "SWAP Coordinates"=w16) -> (instance out=w2)
      w1 = $"error in (no error)"
    }
    frame Error {
      w1 = $"error in (no error)"
      w2 = $"iSRb in"
      w3 = default
      w4 = default
      w5 = default
    }
  }
  $"iSRb out" <- w2
  $"Rectangle Points" <- w3
  $"error out" <- w1
  Max And Min(x=w4, y=w5) -> (min(x,y)=w28: i32)
  $"ROI min(x,y)" <- w28
