vi "iSRb - Write Start End Separators for Dips.gvi"   [LabVIEW NXG 5.1.0]
inputs:
  "iSRb in": "iSRb.gtype", required
  "error in (no error)": error
outputs:
  "iSRb out": "iSRb.gtype"
  "Dips Out": "Dip TypeDef.gtype"[]
  "error out": error
types:
  "Dip TypeDef.gtype" = cluster{"Dip Nr": i32, "Dip Res": f64, "Dip Start": f64, "Dip End": f64, "Valley A Location": f64, "Valley A Amplitude": f64, "Valley A 2nd Derivative": f64, "Valley C Location": f64, "Valley C Amplitude": f64, "Valley C 2nd Derivative": f64, "Peak B Location": f64, "Peak B Amplitude": f64, "Peak B 2nd Derivative": f64, "Dip %": f64, "Double Dip": bool}
uses:
  NI::G Core::Operating System::Write to System Log.gvi
diagram:
  call "Write to System Log.gvi"(message="Dips End Start", severity="Informational"(2))
  case ($"error in (no error)") {
    frame No Error {
      Property Node(instance in=$"iSRb in") -> ("Dips"=w4, "Profile"=w5)
      s1 = 0  # shift register
      for (iteration -> i1) {
        w6 = each element of w4
        Property Node(instance in=w6) -> ("Valley C Location"=w8, "Double Dip"=w9, "Valley A Location"=w10)
        Select(s=w9, t=w8, f=w10) -> w11
        Increment(x=i1) -> w12
        Array Index(array=w4) -> (out0[w12]=w13)
        Property Node(instance in=w13) -> ("Valley C Location"=w14, "Double Dip"=w15, "Valley A Location"=w16)
        Add(w11, w16) -> w17
        Divide(x=w17, y=2) -> w18
        Property Node(instance in=w6, "Dip Start"=s1, "Dip End"=w18) -> (instance out=w19)
        Select(s=w15, t=w14, f=w16)
        append w19 to w7
        next s1 = w18
      }
      Array Size(array=w7) -> (size(s)=w20)
      Decrement(x=w20) -> w21
      Array Size(array=w5) -> (size(s)=w22)
      Decrement(x=w22) -> w23
      Array Index(array=w7) -> (out0[w21]=w24)
      Property Node(instance in=w24, "Dip End"=w23) -> (instance out=w25)
      Replace Array Subset(inArray=w7, index=w21, new=w25) -> w3
      Property Node(instance in=$"iSRb in", "Dips"=w3) -> (instance out=w2)
      w1 = $"error in (no error)"
    }
    frame Error {
      w1 = $"error in (no error)"
      w2 = $"iSRb in"
      w3 = default
    }
  }
  $"error out" <- w1
  $"Dips Out" <- w3
  $"iSRb out" <- w2
