vi "iSRB.gvi"   [LabVIEW NXG 5.1.0]
panel controls:
  "MEASURE": bool
  "UpSampling": f64 = 4
  "First Visible": u16 = "1D"(0)
  "Auto Rotate": bool = TRUE
panel indicators:
  "Image": "Vision IMAQImage"
  "Interpolation Graph": T1[]
  "resulting string": string
  "Polynom": string
  "Line Profile": f32[]
  "Buzy": bool
  "Loaded": bool
types:
  T1 = cluster{"Element 1": cluster{"Dip": f64, "Dip %": f64}[]}
  T2 = cluster{"Element 1": f64, "Element 2": u16, "Element 3": bool}
  T3 = cluster{"ID": enum{"External", "Internal"}, "Type": u32, "Coordinates": i32[]}
  "ROI Descriptor.gtype" = cluster{"Global Rectangle": i32[], "Contours": T3[]}
  T4 = cluster{"Name": string, "Color": u32, "Style": u8, "Point Style": u8, "Name Visible": bool, "Allow Drag": bool, "Cursor Mode": u32, "Plot": i32, "Index": i32, "Position": cluster{"X": f64, "Y": f64}, "X Scale": u32, "Y Scale": u32, "Watch Plots": i32[], "Watch All Plots": bool, "Plot Area": i32, "Label Offset": cluster{"X": f64, "Y": f64}}
uses:
  NI::G Core::File IO (General)::Get System Directory.gvi
  NI::G Core::File IO (General)::File Version Information.gvi
  NI::Vision::Core::Basics::Create Image.gvi
  Main::Move Window to Topmost.gvi
  NI::Vision::Core::Files::Load Image Dialog.gvi
  NI::Vision::Core::Files::Read Image File.gvi
  NI::G Core::Error::Display Error.gvi
  NI::G Core::Error::Is Error.gvi
  Main::Move Window to Bottom.gvi
  NI::Vision::Core::Basics::Array to Image.gvi
  NI::Vision::Core::Overlay::Clear Overlay.gvi
  My Computer::iSRb.gtype::Module SRb - Core.gvi
  NI::Vision::Core::Basics::Image to Array.gvi
  NI::G Core::Operating System::Write to System Log.gvi
  NI::Vision::Core::Overlay::Overlay Multiple Lines.gvi
diagram:
  Create User Event[EventName="Measure!"](user event data type=T2 {all zero or empty}) -> (user event out=w1)  # Create User Event: Measure!
  w2 = path path ""  # Path
  Create User Event[EventName=FileOpen](user event data type=w2) -> (user event out=w3)  # Create User Event: FileOpen
  Register For Events("FileOpen"=w3, "Measure!"=w1) -> (event registration refnum out=w4)
  s1 = uninitialised  # shift register
  for (N = 3) (iteration -> i1) {
    case (i1) {
      frame 0, Default {
        Property Node(instance in=reference to "Image", "ROI"="ROI Descriptor.gtype" {all zero or empty})
        $"resulting string" <- ""
        $Loaded <- FALSE
        call "Get System Directory.gvi"(type="User Desktop") -> (system directory=w6)
        Get Component Directory() -> (Path=w7)
        Build Path(base path=w7, name or relative path="iSRB Measurement.exe") -> (appended path=w8)
        call "File Version Information.gvi"(executable or DLL=w8) -> (file version=w9, error out=w10)
        case (w10) {
          frame Error, Default {
            w11 = "Dev"
          }
          frame No Error {
            w11 = w9
          }
        }
        Concatenate Strings("iSRB Measurement Tool - ", w11) -> w12
        call "Create Image.gvi"(image name="iSRB", image type="Grayscale (U16)"(7)) -> (new image=w13)
        Build Cluster(w13, path "", w12) -> w14
        Property Node(instance in=w14, "Element 2"=w6) -> (instance out=w5)
        Strip Path(path=w7)
        Property Node(instance in=reference to unnamed native front panel) -> ("Window"=w15)
        Property Node(instance in=w15, "Title"=w12) -> (error out=w16)
        call "Move Window to Topmost.gvi"(window name ("")=w12, error in=w16)
      }
      frame 1 {
        s2 = s1  # shift register
        while {
          event (timeout = 50) (dynamic events = w4) {
            on "Timeout" {
              Property Node(instance in=reference to "Image") -> ("ROI"=w19)
              Property Node(instance in=w19) -> ("Contours"=w20)
              Array Index(array=w20) -> (out0[_]=w21)
              Property Node(instance in=w21) -> ("Type"=w22)
              Is Equal(x=w22, y=12) -> w23
              Logical And($Loaded, w23) -> w24
              Not(x=w24) -> w25
              Property Node(instance in=reference to "MEASURE", "Disabled"=w25)
              w17 = default
              w18 = s2
            }
            on "MEASURE" Value changed {
              Build Cluster($UpSampling, $"First Visible", $"Auto Rotate") -> w26
              Generate User Event(event data=w26, user event=w1)
              w17 = default
              w18 = s2
            }
            on "Application menu" Menu selection (User) {
              Event Data() -> ("ItemTag"=w27)
              case (w27) {
                frame Default {
                  One Button Dialog(message=w27)
                  w18 = s2
                  w17 = default
                }
                frame "_Open..." {
                  Property Node(instance in=s2) -> ("Element 1"=w28, instance out=w29)
                  call "Get System Directory.gvi"(type="User Desktop") -> (system directory=w30)
                  call "Load Image Dialog.gvi"(start path=w30) -> (selected path=w31, cancelled?=w32)
                  Property Node(instance in=reference to unnamed native front panel) -> ("Window"=w33)
                  Property Node(instance in=w33) -> ("Title"=w34)
                  case (w32) {
                    frame True {
                      # cancelled...
                      for (N = 2) {
                        call "Move Window to Topmost.gvi"(window name ("")=w34) -> (error out=w35)
                        Wait(time to wait=400)
                      }
                      w18 = w29
                    }
                    frame False {
                      call "Read Image File.gvi"(image in=w28, file path=w31) -> (image out=w36, error out=w37)
                      Property Node(instance in=w29, "Element 1"=w36) -> (instance out=w18)
                      Property Node(instance in=w29) -> ("Element 3"=w38)
                      Path To String(path=w31) -> (string=w39)
                      Concatenate Strings(w38, " - ", w39) -> w40
                      for (N = 2) {
                        call "Move Window to Topmost.gvi"(window name ("")=w34) -> (error out=w41)
                        Wait(time to wait=1000)
                      }
                      Property Node(instance in=w33, "Title"=w40, error in=w41)
                      $Image <- w36
                      case (w37) {
                        frame Error, Default {
                          call "Display Error.gvi"(error in=w37)
                        }
                        frame No Error {
                          $Loaded <- TRUE
                        }
                      }
                    }
                  }
                  while (iteration -> i2) {
                    Is Greater(x=i2, y=4) -> w42
                    call "Move Window to Topmost.gvi"(window name ("")="Open") -> (error out=w43)
                    call "Is Error.gvi"(error in=w43) -> (error?=w44)
                    Not(x=w44) -> w45
                    Logical Or(w45, w42) -> w46
                    case (w46) {
                      frame True { }
                      frame False {
                        call "Move Window to Bottom.gvi"(window name ("")=w34)
                      }
                    }
                    Wait(time to wait=400)
                    stop if w46
                  }
                  w17 = default
                }
                frame "_Demo" {
                  w47 = "ROI Descriptor.gtype" {"Global Rectangle"=[116, 112, 258, 502], "Contours"=[{"ID"="External", "Type"=12, "Coordinates"=[132, 116, 240, 497, 354966]}]}
                  Property Node(instance in=reference to "Image", "ROI"=w47)
                  Property Node(instance in=s2) -> ("Element 1"=w48, instance out=w49)
                  w50 = [[34848, 34794, 34766, 34768, 34836, 34837, 34852, 34843, 34799, 34799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], [34830, 34755, 34683, 34792, 34837, 34835, 34808, 34785, 34790, 34796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], [34791, 34767, 34747, 34741, 34808, 34804, 34824, 34822, 34767, 34807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], [34730, 34758, 34725, 34755, 34777, 34785, 34788, 34765, 34807, 34833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], [34741, 34761, 34820, 34784, 34811, 34866, 34787, 34785, 34793, 34853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], [34767, 34696, 34816, 34816, 34891, 34877, 34865, 34818, 34817, 34835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], [34786, 34712, 34733, 34769, 34827, 34867, 34852, 34904, 34883, 34817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], [34822, 34761, 34793, 34756, 34801, 34784, 34808, 34845, 34870, 34878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], [34766, 34770, 34856, 34866, 34857, 34852, 34812, 34820, 34797, 34857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], [34786, 34828, 34858, 34861, 34840, 34895, 34842, 34865, 34819, 34769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]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]
                  call "Array to Image.gvi"(image in=w48, U16 pixel values=w50) -> (image out=w51)
                  Property Node(instance in=w49, "Element 1"=w51, "Element 2"=path "DEMO") -> (instance out=w18)
                  Build Cluster($UpSampling, $"First Visible", $"Auto Rotate") -> w52
                  Generate User Event(event data=w52, user event=w1)
                  w17 = default
                }
                frame "_Quit" {
                  w18 = s2
                  w17 = TRUE
                }
                frame "_About" {
                  Get Component Directory() -> (Path=w53)
                  Strip Path(path=w53)
                  Build Path(base path=w53, name or relative path="iSRB Measurement.exe") -> (appended path=w54)
                  call "File Version Information.gvi"(executable or DLL=w54) -> (file version=w55, error out=w56)
                  case (w56) {
                    frame Error, Default {
                      w57 = "Dev"
                    }
                    frame No Error {
                      w57 = w55
                    }
                  }
                  Concatenate Strings("iSRB Measurement Tool - v.", w57) -> w58
                  One Button Dialog(message=w58)
                  w18 = s2
                  w17 = default
                }
              }
            }
            on "Window" Close {
              w17 = TRUE
              w18 = s2
            }
            on dynamic event 0 {
              Property Node(instance in=s2) -> ("Element 1"=w59, "Element 2"=w60, instance out=w61)
              call "Read Image File.gvi"(image in=w59, file path=w60) -> (image out=w62, error out=w63)
              Property Node(instance in=w61, "Element 1"=w62) -> (instance out=w18)
              $Image <- w62
              case (w63) {
                frame Error, Default {
                  call "Display Error.gvi"(error in=w63)
                }
                frame No Error {
                  $Loaded <- TRUE
                }
              }
              w17 = default
            }
            on dynamic event 1 {
              Event Data() -> ("Element 1"=w64, "Element 2"=w65, "Element 3"=w66)
              Build Cluster(w64, w65, w66) -> w67
              Property Node(instance in=reference to "Image") -> ("ROI"=w68)  # Vision Image Display properties
              Property Node(instance in=s2) -> ("Element 1"=w69, instance out=w18)
              call "Clear Overlay.gvi"(image in=w69) -> (image out=w70)
              call "Module SRb - Core.gvi"(Parameters=w67, Image=w70, ROI Descriptor=w68) -> (SRb Graphs=w71, Rectangle Points=w72)
              Property Node(instance in=w71) -> ("Line Profile"=w73)
              $"Line Profile" <- w73
              call "Image to Array.gvi"(image in=w70)
              Property Node(instance in=w71) -> ("Polynom String"=w74, "SRb"=w75, "Interpolation Graph"=w76)
              Number To Fractional String(number=w75, precision (6)=1) -> (F-format string=w77)
              $Polynom <- w77
              call "Write to System Log.gvi"(message="MEASURE", severity="Informational"(2))
              $Buzy <- TRUE
              Property Node(instance in=T4 {all zero or empty}, "Name"="SRB", "Position:X"=w75, "Position:Y"=20, "Plot"=0, "Color"=0, "Style"=8) -> (instance out=w78)
              Build Array(w78) -> w79
              Property Node(instance in=reference to "Interpolation Graph") -> ("Cursor"=w80, instance out=w81)
              Property Node(instance in=w80, "Name"="SRB", "Visible"=TRUE, "XPosition"=w75, "YPosition"=20) -> (instance out=w82)
              sequence (after w81) (after w79) (after w82) {
                frame 0 {
                  # cursors list
                  $Buzy <- FALSE
                }
              }
              $"resulting string" <- w74
              $"Interpolation Graph" <- w76
              call "Overlay Multiple Lines.gvi"(color=4294901760, image in=w70, line endpoints=w72) -> (image out=w83)
              $Image <- w83
              w17 = default
            }
          }
          next s2 = w18
          stop if w17
        }
        w5 = s2
      }
      frame 2 {
        w5 = s1
      }
    }
    next s1 = w5
  }
