vi "Module SRb - Core.gvi"   [LabVIEW NXG 5.1.0]
inputs:
  "Parameters": "SRb Params.gtype" = {"UpSampling"=1, "First Visible"=0, "Auto Rotate"=TRUE}
  "Image": "Vision IMAQImage" = "remote image 000002C32829A058"  # Image is the input image used for the intensity measurement.
  "ROI Descriptor": T2 = {"Global Rectangle"=[72, 33, 385, 109], "Contours"=[{"ID"="External", "Type"=12, "Coordinates"=[74, 47, 346, 92, 3611]}, {"ID"="External", "Type"=1, "Coordinates"=[74, 33]}, {"ID"="External", "Type"=1, "Coordinates"=[384, 108]}]}, required  # Rectangle specifies a rectangular region of an image. The Left/Top/Right/Bottom coordinates describe a nonrotated rectangle. The Rotation angle specifies the rotation angle of the rectangle around its center.
  "Width (3)": i32 = 3
outputs:
  "SRb Results": "SRb Results.gtype"
  "SRb Graphs": "SRb Graphs Info.gtype"
  "Rectangle Points": "Point Coordinates.gtype"[]  # Rectangle Points returns the actual coordinates of the summits of the rectangle.
panel controls:
  "angle": f64
panel indicators:
  "Numeric": f64
types:
  T1 = cluster{"ID": enum{"External", "Internal"}, "Type": u32, "Coordinates": i32[]}
  T2 = cluster{"Global Rectangle": i32[], "Contours": T1[]}
  "SRb Results.gtype" = cluster{"SRb": f32}
  "Dip TypeDef.gtype" = cluster{"Dip Nr": i32, "Dip Res": f64, "Dip Start": f64, "Dip End": f64, "Valley A Location": f64, "Valley A Amplitude": f64, "Valley A 2nd Derivative": f64, "Valley C Location": f64, "Valley C Amplitude": f64, "Valley C 2nd Derivative": f64, "Peak B Location": f64, "Peak B Amplitude": f64, "Peak B 2nd Derivative": f64, "Dip %": f64, "Double Dip": bool}
  T3 = cluster{"Element 1": cluster{"Dip": f64, "Dip %": f64}[]}
  "SRb Graphs Info.gtype" = cluster{"Line Profile": f32[], "Dips": "Dip TypeDef.gtype"[], "Interpolation Graph": T3[], "Angles Graph": f64[], "Polynom String": string, "SRb": f64}
  "SRb Params.gtype" = cluster{"UpSampling": i32, "First Visible": u16, "Auto Rotate": bool}
  "Point Coordinates.gtype" = cluster{"X": f32, "Y": f32}
uses:
  My Computer::iSRb.gtype::iSRb - Write Ref Image.gvi
  NI::Vision::Algorithms::ROI Conversion::Convert ROI to Rectangle.gvi
  My Computer::iSRb.gtype::iSRb - Write ROI.gvi
  NI::G Core::Operating System::Write to System Log.gvi
  My Computer::iSRb.gtype::iSRb - Set Relative Angle.gvi
  My Computer::iSRb.gtype::iSRb - Compute Averaged Line Profile.gvi
  My Computer::iSRb.gtype::iSRb - Peaks Valleys Detector.gvi
  My Computer::iSRb.gtype::iSRb - Filter Valleys.gvi
  My Computer::iSRb.gtype::iSRb - Detect Doubles and Write Dips.gvi
  My Computer::iSRb.gtype::iSRb - Write Start End Separators for Dips.gvi
  My Computer::iSRb.gtype::iSRb - Compute Dips Percentages.gvi
  My Computer::iSRb.gtype::iSRb - Compute (i)SRb.gvi
diagram:
  Property Node(instance in=$Parameters) -> ("Auto Rotate"=w1, "First Visible"=w2, "UpSampling"=w3)
  call "iSRb - Write Ref Image.gvi"(iSRb in="iSRb.gtype" constant, Image=$Image) -> (iSRb out=w4)
  # +- 5 degrees in 16 steps aeach test in three passes
  Absolute Value(x=-10) -> w5
  Divide(x=28, y=2) -> w6
  Divide(x=w5, y=w6) -> w7
  Divide(x=w7, y=w6) -> w8
  Divide(x=w8, y=w6) -> w9
  Build Array(w7, w8, w9) -> w10
  call "Convert ROI to Rectangle.gvi"(ROI descriptor=$"ROI Descriptor") -> (rectangle=w11)
  # ROI
  # ToDo calc median
  Property Node(instance in=w11) -> ("Left"=w12, "Top"=w13, "Right"=w14, "Bottom"=w15)
  Subtract(x=w13, y=w15) -> w16
  Absolute Value(x=w16) -> w17
  Subtract(x=w12, y=w14) -> w18
  Absolute Value(x=w18) -> w19
  Max And Min(x=w19, y=w17) -> (max(x,y)=w20: i32)
  case (w3) {
    frame ..0 {
      case (w20) {
        frame 601..1200 {
          w21 = 2
        }
        frame ..600 {
          w21 = 4
        }
        frame 1201.., Default {
          w21 = 1
        }
      }
    }
    frame Default {
      w21 = w3
    }
  }
  case (w1) {
    frame False, Default {
      call "iSRb - Write ROI.gvi"(iSRb in=w4, ROI=$"ROI Descriptor") -> (iSRb out=w22)
      w23 = $angle
      w24 = default
    }
    frame True {
      s1 = w4  # shift register
      s2 = -10  # shift register
      for (N = 1) {
        w25 = each element of w10
        Absolute Value(x=s2) -> w26
        s3 = s2  # shift register
        for (N = 28) (after w26) {
          call "Write to System Log.gvi"(message="CYCLE", severity="Informational"(2))
          call "iSRb - Write ROI.gvi"(iSRb in=s1, ROI=$"ROI Descriptor") -> (iSRb out=w28)
          call "iSRb - Set Relative Angle.gvi"(iSRb in=w28, Angle=s3) -> (iSRb out=w29)
          call "iSRb - Compute Averaged Line Profile.gvi"(iSRb in=w29, UpSampling=w21) -> (iSRb out=w30)
          call "iSRb - Peaks Valleys Detector.gvi"(iSRb in=w30, Width (3)=$"Width (3)") -> (iSRb out=w31)
          call "iSRb - Filter Valleys.gvi"(iSRb in=w31) -> (iSRb out=w32)
          call "iSRb - Detect Doubles and Write Dips.gvi"(iSRb in=w32) -> (iSRb out=w33)
          call "iSRb - Write Start End Separators for Dips.gvi"(iSRb in=w33) -> (iSRb out=w34)
          call "iSRb - Compute Dips Percentages.gvi"(iSRb in=w34) -> (iSRb out=w35)
          call "iSRb - Compute (i)SRb.gvi"(First Visible=w2, iSRb in=w35) -> (iSRb out=w36, SRb=w37)
          Is Greater Than 0(x=w37) -> w38
          Add(s3, w25) -> w39
          append w37 to w24 if w38
          append s3 to w27 if w38
          next s3 = w39
        }
        Preserve Run Time Class(object in=w36, target object=s1) -> (object out=w40)
        call "iSRb - Write ROI.gvi"(iSRb in=w40, ROI=$"ROI Descriptor") -> (iSRb out=w41)
        Divide(x=w25, y=2) -> w42
        Array Max And Min(array=w24) -> (min index(es)=w43)
        Array Index(array=w27) -> (out0[w43]=w23)
        Subtract(x=w23, y=w42) -> w44
        next s1 = w41
        next s2 = w44
      }
      w22 = s1
    }
  }
  call "iSRb - Set Relative Angle.gvi"(iSRb in=w22, Angle=w23) -> (iSRb out=w45, Rectangle Points=w46)
  call "iSRb - Compute Averaged Line Profile.gvi"(iSRb in=w45, UpSampling=w21) -> (iSRb out=w47, Profile=w48)
  call "iSRb - Peaks Valleys Detector.gvi"(iSRb in=w47, Width (3)=$"Width (3)") -> (iSRb out=w49)
  call "iSRb - Filter Valleys.gvi"(iSRb in=w49) -> (iSRb out=w50)
  call "iSRb - Detect Doubles and Write Dips.gvi"(iSRb in=w50) -> (iSRb out=w51)
  call "iSRb - Write Start End Separators for Dips.gvi"(iSRb in=w51) -> (iSRb out=w52)
  call "iSRb - Compute Dips Percentages.gvi"(iSRb in=w52) -> (iSRb out=w53, Dips=w54)
  call "iSRb - Compute (i)SRb.gvi"(First Visible=w2, iSRb in=w53) -> (SRb=w55, Output Graph=w56, resulting string=w57)
  Property Node(instance in="SRb Graphs Info.gtype" {all zero or empty}, "Angles Graph"=w24, "Line Profile"=w48, "Dips"=w54, "Polynom String"=w57, "Interpolation Graph"=w56, "SRb"=w55) -> (instance out=w58)
  $"SRb Graphs" <- w58
  $"Rectangle Points" <- w46
  Property Node(instance in="SRb Results.gtype" {all zero or empty}, "SRb"=w55) -> (instance out=w59)
  $"SRb Results" <- w59
  $Numeric <- w23
