vi "iSRB - Apply Angle to Rotated Rectngle.gvi"   [LabVIEW NXG 5.1.0]
inputs:
  "rectangle In": "Rectangle Coordinates.gtype"
  "Angle": f64
  "Swap Coordinatges": bool
outputs:
  "rectangle out": "Rectangle Coordinates.gtype"
types:
  "Rectangle Coordinates.gtype" = cluster{"Left": i32, "Top": i32, "Right": i32, "Bottom": i32, "Rotation": f64}
diagram:
  case ($"Swap Coordinatges") {
    frame False, Default {
      Property Node(instance in=$"rectangle In") -> ("Bottom"=w2, "Top"=w3, "Rotation"=w1)
    }
    frame True {
      Property Node(instance in=$"rectangle In") -> ("Right"=w2, "Left"=w3, "Rotation"=w1)
    }
  }
  Add(w1, $Angle) -> w4
  Subtract(x=w2, y=w3) -> w5
  Multiply(w5, 0.2) -> w6
  Subtract(x=w2, y=w6) -> w7
  Add(w3, w6) -> w8
  case ($"Swap Coordinatges") {
    frame True {
      Property Node(instance in=$"rectangle In", "Right"=w7, "Left"=w8, "Rotation"=w4) -> (instance out=w9)
    }
    frame False {
      Property Node(instance in=$"rectangle In", "Bottom"=w7, "Top"=w8, "Rotation"=w4) -> (instance out=w9)
    }
  }
  $"rectangle out" <- w9
