vi "iSRb - Compute (2737)SRb.gvi"   [LabVIEW Conversion 5.1.0]
inputs:
  "First Visible": u16 = "1D"(0)
  "iSRb in": "iSRb.gtype", required
  "error in (no error)": error
outputs:
  "iSRb out": "iSRb.gtype"
  "SRb": f64
  "error out": error
panel indicators:
  "iSRb": f64
diagram:
  case ($"error in (no error)") {
    frame No Error {
      Property Node(instance in=$"iSRb in") -> ("Dips"=w4, "Dips Spacing"=w5)
      Delete From Array(inArray=w5, length (1)=$"First Visible", index0=0) -> w6
      for {
        w7 = each element of w4
        w8 = each element of w6
        Property Node(instance in=w8) -> ("Dip"=w10)
        Property Node(instance in=w7) -> ("Dip %"=w11)
        Property Node(instance in=cluster{"Dip": f64, "Dip %": f64} {all zero or empty}, "Dip"=w10, "Dip %"=w11) -> (instance out=w12)
        append w12 to w9
      }
      s1 = Inf  # shift register
      s2 = FALSE  # shift register
      for {
        w13 = each element of w9
        Property Node(instance in=w13) -> ("Dip"=w14, "Dip %"=w15)
        Is Less(x=w15, y=20) -> w16
        case (w16) {
          frame False, Default {
            w17 = s1
            w18 = s2
          }
          frame True {
            case (s2) {
              frame False, Default {
                w18 = TRUE
                w17 = w14
              }
              frame True {
                w18 = s2
                w17 = s1
              }
            }
          }
        }
        next s1 = w17
        next s2 = w18
      }
      s3 = 100  # shift register
      for {
        w19 = each element of w4
        Property Node(instance in=w19) -> ("Dip %"=w21)
        # give 10%
        # sometimes next dip large than prev
        Multiply(s3, 1.2) -> w22
        Is Less Or Equal(x=w21, y=w22) -> w23
        append w23 to w20
        next s3 = w21
      }
      And Array Elements(Boolean array=w20) -> (logical AND=w24)
      Logical And(w24, s2) -> w25
      Select(s=w25, t=s1, f=Inf) -> w3
      Property Node(instance in=$"iSRb in", "(i)SRb Result"=w3) -> (instance out=w2)
      $iSRb <- w3
      w1 = $"error in (no error)"
    }
    frame Error {
      w1 = $"error in (no error)"
      w2 = $"iSRb in"
      w3 = default
    }
  }
  $"iSRb out" <- w2
  $SRb <- w3
  $"error out" <- w1
