vi "iSRb - Compute (i)SRb.gvi"   [LabVIEW NXG 5.1.0]
inputs:
  "First Visible": u16 = "1D"(0)
  "iSRb in": "iSRb.gtype", required
  "error in (no error)": error
outputs:
  "Output Graph": T1[]
  "Dips": "Dip TypeDef.gtype"[]
  "iSRb out": "iSRb.gtype"
  "SRb": f64
  "error out": error
  "resulting string": string
panel indicators:
  "Polynomial Coefficients": f64[]  # Polynomial Coefficients returns the coefficients of the fitted model in ascending order of power. The total number of elements in Polynomial Coefficients is m + 1, where m is the polynomial order.
  "iSRb": f64
  "iSRB 2": f64
types:
  "Dip TypeDef.gtype" = cluster{"Dip Nr": i32, "Dip Res": f64, "Dip Start": f64, "Dip End": f64, "Valley A Location": f64, "Valley A Amplitude": f64, "Valley A 2nd Derivative": f64, "Valley C Location": f64, "Valley C Amplitude": f64, "Valley C 2nd Derivative": f64, "Peak B Location": f64, "Peak B Amplitude": f64, "Peak B 2nd Derivative": f64, "Dip %": f64, "Double Dip": bool}
  T1 = cluster{"Element 1": cluster{"Dip": f64, "Dip %": f64}[]}
uses:
  NI::G Core::Operating System::Write to System Log.gvi
  NI::Analysis::Fitting::General Polynomial Fit.gvi
  NI::Analysis::Polynomial::Polynomial Roots (DBL).gvi
diagram:
  call "Write to System Log.gvi"(message="Final Polynom", severity="Informational"(2))
  case ($"error in (no error)") {
    frame No Error {
      Property Node(instance in=$"iSRb in") -> ("Dips"=w4, "Dips Spacing"=w5)
      Delete From Array(inArray=w5, length (1)=$"First Visible", index0=0) -> w6
      for (iteration -> i1) {
        w7 = each element of w4
        w8 = each element of w6
        Property Node(instance in=w8) -> ("Dip"=w11)
        Add($"First Visible", i1) -> w12
        Increment(x=w12) -> w13
        Property Node(instance in=w7, "Dip Nr"=w13, "Dip Res"=w11) -> (instance out=w14)
        Property Node(instance in=w7) -> ("Dip %"=w15)
        Property Node(instance in=cluster{"Dip": f64, "Dip %": f64} {all zero or empty}, "Dip"=w11, "Dip %"=w15) -> (instance out=w16)
        append w16 to w9
        append w14 to w10
      }
      $Dips <- w10
      Build Array(w9, cluster{"Dip": f64, "Dip %": f64} {all zero or empty}) -> w17
      for {
        w18 = each element of w9
        Property Node(instance in=w18) -> ("Dip %"=w20)
        Is Not Equal To 0(x=w20) -> w21
        append w18 to w19 if w21
      }
      Array Size(array=w19) -> (size(s)=w22)
      Subtract(x=w22, y=6) -> w23
      Array Subset(array=w19, index0=w23, length0=99) -> w24
      Array Size(array=w24) -> (size(s)=w25)
      Decrement(x=w25) -> w26
      Array Index(array=w24) -> (out0[w26]=w27)
      Property Node(instance in=w27) -> ("Dip"=w28, "Dip %"=w29)
      Is Less(x=w29, y=20) -> w30
      Not(x=w30) -> w31
      for (iteration -> i2) {
        w32 = each element of w9
        Property Node(instance in=w32) -> ("Dip"=w33)
        Is Equal(x=w33, y=w28) -> w34
        stop if w34
      }
      Increment(x=i2) -> w35
      Array Index(array=w9) -> (out0[w35]=w36)
      Build Array(w24, w36) -> w37
      Select(s=w31, t=w37, f=w24) -> w38
      Delete From Array(inArray=w38, length (1)=1, index0=0) -> w39
      Select(s=w31, t=w39, f=w38) -> w40
      for {
        w41 = each element of w40
        Property Node(instance in=w41) -> ("Dip %"=w44, "Dip"=w45)
        append w45 to w42
        append w44 to w43
      }
      call "General Polynomial Fit.gvi"(algorithm="SVD"(0), method="Least Square"(0), y=w43, x=w42, tolerance=1, polynomial order=2) -> (polynomial coefficients=w46, error out=w47)
      Array Index(array=w46) -> (out0[_]=w48)
      w49 = 20  # %
      Subtract(x=w48, y=w49) -> w50
      Replace Array Subset(inArray=w46, index=0, new=w50) -> w51
      call "Polynomial Roots (DBL).gvi"(polynomial=w51) -> (roots=w52)
      Complex To Real And Imaginary(x + iy=w52) -> w53
      for {
        w54 = each element of w53
        Is Greater Than 0(x=w54) -> w56
        append w54 to w55 if w56
      }
      Array Max And Min(array=w55) -> (min value=w57)
      # safety - next dip must be greater than zero
      for (iteration -> i3) (after w17) {
        Increment(x=i3) -> w58
        Array Index(array=w17) -> (out0[i3]=w59, out1[w58]=w60)
        Property Node(instance in=w59) -> ("Dip %"=w61, "Dip"=w62)
        Is Not Equal To 0(x=w61) -> w63
        Property Node(instance in=w60) -> ("Dip"=w64)
        In Range And Coerce(lower limit=w64, upper limit=w62, x=w57) -> (In Range?=w65)
        Logical And(w63, w65) -> w66
        stop if w66
      }
      s1 = 100  # shift register
      for {
        w67 = each element of w10
        Property Node(instance in=w67) -> ("Dip %"=w69)
        # give 25% more
        # then next could be slightly larger
        Multiply(s1, 1.25) -> w70
        Is Less Or Equal(x=w69, y=w70) -> w71
        append w71 to w68
        next s1 = w69
      }
      And Array Elements(Boolean array=w68) -> (logical AND=w72)
      Logical And(w72, w66) -> w73
      Select(s=w73, t=w57, f=Inf) -> w3
      Property Node(instance in=$"iSRb in", "(i)SRb Result"=w3) -> (instance out=w2)
      $iSRb <- w3
      $"Polynomial Coefficients" <- w46
      Array Index(array=w46) -> (out0[_]=w74, out1[_]=w75, out2[_]=w76)
      for (N = 320) (iteration -> i4) {
        Add(80, i4) -> w78
        Square(x=w78) -> w79
        Multiply(w79, w76) -> w80
        Multiply(w78, w75) -> w81
        Add(w80, w81, w74) -> w82
        w83 = cluster{"Element 1": i32, "Element 2": f64} {all zero or empty}
        Property Node(instance in=w83, "Element 1"=w78, "Element 2"=w82) -> (instance out=w84)
        append w84 to w77
      }
      Build Cluster Array(w40, w77) -> (out=w85)
      Coerce To Type(type=T1[] [], x=w85) -> w86
      $"Output Graph" <- w86
      $"iSRB 2" <- w57
      Array Index(array=w46) -> (out0[_]=w87, out1[_]=w88, out2[_]=w89)
      Format Into String(formatString="y = %fx²+%fx%f", w89, w88, w87) -> w90
      $"resulting string" <- w90
      w1 = $"error in (no error)"
    }
    frame Error {
      w1 = $"error in (no error)"
      w2 = $"iSRb in"
      w3 = default
    }
  }
  $"iSRb out" <- w2
  $SRb <- w3
  $"error out" <- w1
