vi "iSRb - Compute Averaged Line Profile.gvi"   [LabVIEW NXG 5.1.0]
inputs:
  "iSRb in": "iSRb.gtype", required
  "UpSampling": i32 = 1
  "error in (no error)": error
outputs:
  "iSRb out": "iSRb.gtype"
  "error out": error
  "Profile": f32[]
types:
  "SRb Line Profile.gtype" = f32[]
uses:
  My Computer::LV_ASTM_Toolbox.sli::GetProfile
diagram:
  case ($"error in (no error)") {
    frame No Error {
      Property Node(instance in=$"iSRb in") -> ("Ref Image"=w4, "Rectangle Points"=w5, "SWAP Coordinates"=w6)
      case (w6) {
        frame False, Default {
          w7 = w5
        }
        frame True {
          Array Index(array=w5) -> (out0[_]=w8, out1[_]=w9, out2[_]=w10, out3[_]=w11)
          Build Array(w11, w8, w9, w10, w11) -> w7
        }
      }
      Round To Nearest(number=w7) -> w12
      call "GetProfile"(image in=w4, RectCoords in=w12, UpSampling in=$UpSampling, Profile in="SRb Line Profile.gtype" [], error in=$"error in (no error)") -> (UpSampling out=w13, Profile out=w14, error out=w1)
      Reverse 1D Array(array=w14) -> (reversed array=w15)
      Array Max And Min(array=w14) -> (min index(es)=w16)
      Array Size(array=w14) -> (size(s)=w17)
      Quotient And Remainder(x=w17, y=2) -> (floor(x/y)=w18)
      Is Greater(x=w16, y=w18) -> w19
      Select(s=w19, t=w15, f=w14) -> w3
      Property Node(instance in=$"iSRb in", "UpSampling"=w13, "Profile"=w3) -> (instance out=w2)
    }
    frame Error {
      w1 = $"error in (no error)"
      w2 = $"iSRb in"
      w3 = default
    }
  }
  $"iSRb out" <- w2
  $Profile <- w3
  $"error out" <- w1
