vi "iSRb - Detect Doubles and Write Dips.gvi"   [LabVIEW NXG 5.1.0]
inputs:
  "iSRb in": "iSRb.gtype", required
  "error in (no error)": error
outputs:
  "iSRb out": "iSRb.gtype"
  "Dips": "Dip TypeDef.gtype"[]
  "error out": error
types:
  "Dip TypeDef.gtype" = cluster{"Dip Nr": i32, "Dip Res": f64, "Dip Start": f64, "Dip End": f64, "Valley A Location": f64, "Valley A Amplitude": f64, "Valley A 2nd Derivative": f64, "Valley C Location": f64, "Valley C Amplitude": f64, "Valley C 2nd Derivative": f64, "Peak B Location": f64, "Peak B Amplitude": f64, "Peak B 2nd Derivative": f64, "Dip %": f64, "Double Dip": bool}
uses:
  NI::G Core::Operating System::Write to System Log.gvi
diagram:
  call "Write to System Log.gvi"(message="Dips", severity="Informational"(2))
  case ($"error in (no error)") {
    frame No Error {
      Property Node(instance in=$"iSRb in") -> ("Profile"=w4)
      Property Node(instance in=$"iSRb in") -> ("Valid Valleys Indexes"=w5, "RAW Valleys Info"=w6, "RAW Valleys Info"=w7, "RAW Peaks Info"=w8)
      Array Index(array=w5) -> (out0[_]=w9)
      Build Array(w9) -> w10
      Property Node(instance in=cluster{"Element 1": i32[]} {all zero or empty}, "Element 1"=w10) -> (instance out=w11)
      Build Array(w11) -> w12
      Property Node(instance in=w6) -> ("Locations"=w13, "Amplitudes"=w14)
      for {
        w15 = each element of w5
        Array Index(array=w13) -> (out0[w15]=w17)
        Array Index(array=w14)
        append w17 to w16
      }
      s1 = 0  # shift register
      for (iteration -> i1) {
        w18 = each element of w16
        w19 = each element of w5
        Subtract(x=w18, y=s1) -> w22
        Is Not Equal To 0(x=i1) -> w23
        append w22 to w20 if w23
        append w19 to w21 if w23
        next s1 = w18
      }
      Array Index(array=w20) -> (out0[_]=w24, out1[_]=w25)
      Multiply(w24, 1.1) -> w26
      Is Greater(x=w25, y=w26) -> w27
      s2 = w12  # shift register
      for {
        w28 = each element of w20
        w29 = each element of w21
        Is Less(x=w28, y=w26) -> w30
        Logical And(w30, w27) -> w31
        case (w31) {
          frame False, Default {
            Build Array(w29) -> w33
            Property Node(instance in=cluster{"Element 1": i32[]} {all zero or empty}, "Element 1"=w33) -> (instance out=w34)
            Build Array(s2, w34) -> w32
          }
          frame True {
            Array Size(array=s2) -> (size(s)=w35)
            Decrement(x=w35) -> w36
            Array Index(array=s2) -> (out0[w36]=w37)
            Property Node(instance in=w37) -> ("Element 1"=w38)
            Build Array(w38, w29) -> w39
            Property Node(instance in=cluster{"Element 1": i32[]} {all zero or empty}, "Element 1"=w39) -> (instance out=w40)
            Replace Array Subset(inArray=s2, index=w36, new=w40) -> w32
          }
        }
        next s2 = w32
      }
      for {
        w41 = each element of s2
        Property Node(instance in=w41) -> ("Element 1"=w43)
        Array Size(array=w43) -> (size(s)=w44)
        Is Equal(x=w44, y=2) -> w45
        case (w45) {
          frame False, Default {
            Property Node(instance in=w7) -> ("Locations"=w47, "Amplitudes"=w48, "2nd Derivatives"=w49)
            Array Index(array=w43) -> (out0[_]=w50)
            Array Index(array=w47) -> (out0[w50]=w51)
            Array Index(array=w48) -> (out0[w50]=w52)
            Array Index(array=w49) -> (out0[w50]=w53)
            Property Node(instance in="Dip TypeDef.gtype" {all zero or empty}, "Double Dip"=FALSE, "Valley A Location"=w51, "Valley A Amplitude"=w52, "Valley A 2nd Derivative"=w53) -> (instance out=w46)
          }
          frame True {
            Property Node(instance in=w7) -> ("Locations"=w54, "Amplitudes"=w55, "2nd Derivatives"=w56)
            Array Index(array=w43) -> (out0[_]=w57, out1[_]=w58)
            Array Index(array=w54) -> (out0[w57]=w59)
            Array Index(array=w55) -> (out0[w57]=w60)
            Array Index(array=w56) -> (out0[w57]=w61)
            Array Index(array=w54) -> (out0[w58]=w62)
            Array Index(array=w55) -> (out0[w58]=w63)
            Array Index(array=w56) -> (out0[w58]=w64)
            Property Node(instance in=w8) -> ("Locations"=w65, "Amplitudes"=w66, "2nd Derivatives"=w67)
            Array Index(array=w54) -> (out0[w57]=w68, out1[w58]=w69)
            for (iteration -> i2) {
              w70 = each element of w65
              In Range And Coerce[IncludeLowLimit=False](lower limit=w68, upper limit=w69, x=w70) -> (In Range?=w72)
              append i2 to w71 if w72
            }
            Array Index(array=w71) -> (out0[_]=w73)
            Array Index(array=w65) -> (out0[w73]=w74)
            Array Index(array=w66) -> (out0[w73]=w75)
            Array Index(array=w67) -> (out0[w73]=w76)
            Property Node(instance in="Dip TypeDef.gtype" {all zero or empty}, "Double Dip"=TRUE, "Valley A Location"=w59, "Valley A Amplitude"=w60, "Valley A 2nd Derivative"=w61, "Valley C Location"=w62, "Valley C Amplitude"=w63, "Valley C 2nd Derivative"=w64, "Peak B Location"=w74, "Peak B Amplitude"=w75, "Peak B 2nd Derivative"=w76) -> (instance out=w46)
          }
        }
        append w46 to w42
      }
      # sit peaks and calleys on the profile
      # technically its not very correct, but will raise many questions
      # if we will take real peaks amplitudes.
      # Will d oas shown in ASTM book
      # .AD. 22-JUN-2017
      for {
        w77 = each element of w42
        Property Node(instance in=w77) -> ("Valley A Location"=w78, "Valley C Location"=w79, "Peak B Location"=w80)
        Array Index(array=w4) -> (out0[w78]=w81)
        Array Index(array=w4) -> (out0[w79]=w82)
        Array Index(array=w4) -> (out0[w80]=w83)
        Property Node(instance in=w77, "Valley A Amplitude"=w81, "Valley C Amplitude"=w82, "Peak B Amplitude"=w83) -> (instance out=w84)
        append w84 to w3
      }
      Property Node(instance in=$"iSRb in", "Dips"=w3) -> (instance out=w2)
      w1 = $"error in (no error)"
    }
    frame Error {
      w1 = $"error in (no error)"
      w2 = $"iSRb in"
      w3 = default
    }
  }
  $"error out" <- w1
  $Dips <- w3
  $"iSRb out" <- w2
