vi "iSRb - Filter Valleys.gvi"   [LabVIEW NXG 5.1.0]
inputs:
  "iSRb in": "iSRb.gtype", required
  "error in (no error)": error
outputs:
  "iSRb out": "iSRb.gtype"
  "valid valleys": i32[]
  "error out": error
  "RAW Valleys Info.Amplitudes": f64[]
diagram:
  case ($"error in (no error)") {
    frame No Error {
      Property Node(instance in=$"iSRb in") -> ("RAW Valleys Info"=w5, "Profile"=w6)
      Property Node(instance in=w5) -> ("Amplitudes"=w4)
      Array Max And Min(array=w6) -> (max value=w7, min value=w8)
      Subtract(x=w7, y=w8) -> w9
      Divide(x=w9, y=2) -> w10
      Add(w10, w8) -> w11
      # thr
      s1 = w11  # shift register
      for (iteration -> i1) {
        w12 = each element of w4
        Is Less(x=w12, y=s1) -> w13
        case (w13) {
          frame False, Default {
            w14 = s1
          }
          frame True {
            Subtract(x=w7, y=w12) -> w15
            Divide(x=w15, y=2) -> w16
            Add(w16, w12) -> w14
          }
        }
        append i1 to w3 if w13
        next s1 = w14
      }
      Property Node(instance in=$"iSRb in", "Valid Valleys Indexes"=w3) -> (instance out=w2)
      w1 = $"error in (no error)"
    }
    frame Error {
      w1 = $"error in (no error)"
      w2 = $"iSRb in"
      w3 = default
      w4 = default
    }
  }
  $"iSRb out" <- w2
  $"RAW Valleys Info.Amplitudes" <- w4
  $"valid valleys" <- w3
  $"error out" <- w1
