vi "iSRb - Peaks Valleys Detector.gvi"   [LabVIEW NXG 5.1.0]
inputs:
  "iSRb in": "iSRb.gtype", required
  "Width (3)": i32 = 3
  "error in (no error)": error
outputs:
  "iSRb out": "iSRb.gtype"
  "RAW Valleys Info": T1
  "RAW Peaks Info": T1
  "error out": error
types:
  T1 = cluster{"Locations": f64[], "Amplitudes": f64[], "2nd Derivatives": f64[]}
uses:
  NI::G Core::Operating System::Write to System Log.gvi
  NI::Vision::Algorithms::Measure::Peak-Valley Detector.gvi
diagram:
  case ($"error in (no error)") {
    frame No Error {
      call "Write to System Log.gvi"(message="Peaks Info", severity="Informational"(2))
      Property Node(instance in=$"iSRb in") -> ("Profile"=w5)
      call "Peak-Valley Detector.gvi"(pixel values=w5, width=$"Width (3)", peaks/valleys="Peaks", error in=$"error in (no error)") -> (locations=w6, amplitudes=w7, 2nd derivatives=w8, error out=w9)
      Build Cluster(w6, w7, w8) -> w10
      call "Peak-Valley Detector.gvi"(pixel values=w5, threshold=65536, width=$"Width (3)", peaks/valleys="Valleys", error in=w9) -> (locations=w11, amplitudes=w12, 2nd derivatives=w13, error out=w1)
      Build Cluster(w11, w12, w13) -> w14
      Property Node(instance in=$"iSRb in", "RAW Peaks Info"=w10, "RAW Valleys Info"=w14) -> (instance out=w2)
      Property Node(instance in=w2) -> ("RAW Peaks Info"=w3, "RAW Valleys Info"=w4)
    }
    frame Error {
      w1 = $"error in (no error)"
      w2 = $"iSRb in"
      w3 = default
      w4 = default
    }
  }
  $"iSRb out" <- w2
  $"RAW Peaks Info" <- w3
  $"RAW Valleys Info" <- w4
  $"error out" <- w1
