vi "iSRb - Set Relative Angle.gvi"   [LabVIEW NXG 5.1.0]
inputs:
  "iSRb in": "iSRb.gtype", required
  "Angle": f64
  "error in (no error)": error
outputs:
  "iSRb out": "iSRb.gtype"
  "Rectangle Points": "Point Coordinates.gtype"[]  # Rectangle Points returns the actual coordinates of the summits of the rectangle.
  "ROI min(x,y)": i32
  "error out": error
types:
  "Point Coordinates.gtype" = cluster{"X": f32, "Y": f32}
uses:
  NI::Vision::Algorithms::ROI Conversion::Convert ROI to Rectangle.gvi
  My Computer::iSRb.gtype::iSRB - Apply Angle to Rotated Rectngle.gvi
  NI::Vision::Algorithms::ROI Conversion::Convert Rectangle to ROI (Polygon).gvi
diagram:
  case ($"error in (no error)") {
    frame No Error {
      # bottom top to right left
      Property Node(instance in=$"iSRb in") -> ("ROI"=w5)
      Property Node(instance in=w5) -> ("Contours"=w6)
      Array Index(array=w6) -> (out0[_]=w7)
      Property Node(instance in=w7) -> ("Points"=w8)
      Array Index(array=w8) -> (out0[_]=w9, out1[_]=w10, out2[_]=w11, out3[_]=w12)
      Subtract(x=w9, y=w11) -> w13
      Absolute Value(x=w13) -> w14
      Subtract(x=w10, y=w12) -> w15
      Absolute Value(x=w15) -> w16
      Is Less(x=w14, y=w16) -> w17
      call "Convert ROI to Rectangle.gvi"(ROI descriptor=w5, error in=$"error in (no error)") -> (rectangle=w18, error out=w19)
      call "iSRB - Apply Angle to Rotated Rectngle.gvi"(rectangle In=w18, Angle=$Angle, Swap Coordinatges=w17) -> (rectangle out=w20)
      call "Convert Rectangle to ROI (Polygon).gvi"(rectangle=w20, error in=w19) -> (ROI descriptor=w21, rectangle points=w3, error out=w1)
      Property Node(instance in=$"iSRb in", "ROI"=w21, "Rectangle Points"=w3, "SWAP Coordinates"=w17) -> (instance out=w2)
      Max And Min(x=w16, y=w14) -> (min(x,y)=w4: i32)
    }
    frame Error {
      w1 = $"error in (no error)"
      w2 = $"iSRb in"
      w3 = default
      w4 = 0
    }
  }
  $"iSRb out" <- w2
  $"Rectangle Points" <- w3
  $"ROI min(x,y)" <- w4
  $"error out" <- w1
