vi "iSRb - Write ROI.gvi"   [LabVIEW NXG 5.1.0]
inputs:
  "iSRb in": "iSRb.gtype", required
  "ROI": T2, required
  "error in (no error)": error
outputs:
  "iSRb out": "iSRb.gtype"
  "error out": error
types:
  T1 = cluster{"Contour Type": u32, "ROI Type": u32, "Points": i32[]}
  T2 = cluster{"Global Rectangle": i32[], "Contours": T1[]}
uses:
  NI::Vision::Algorithms::ROI Conversion::Convert ROI to Rectangle.gvi
  NI::Vision::Algorithms::ROI Conversion::Convert Rectangle to ROI (Polygon).gvi
diagram:
  case ($"error in (no error)") {
    frame No Error {
      call "Convert ROI to Rectangle.gvi"(ROI descriptor=$ROI, error in=$"error in (no error)") -> (rectangle=w3, error out=w4)
      call "Convert Rectangle to ROI (Polygon).gvi"(rectangle=w3, error in=w4) -> (rectangle points=w5, error out=w1)
      Property Node(instance in=$"iSRb in", "ROI"=$ROI, "Rectangle Points"=w5) -> (instance out=w2)
    }
    frame Error {
      w1 = $"error in (no error)"
      w2 = $"iSRb in"
    }
  }
  $"iSRb out" <- w2
  $"error out" <- w1
